% Simulink data dictionary RoverPlatformInterfaces.sldd

TwistStamped = Simulink.Bus()
  linear_x: double, Unit="m/s"
  angular_z: double, Unit="rad/s"
  stamp: double, Unit="s"

BoolFlag = Simulink.Bus()
  data: double

DriveMode = Simulink.Bus()
  mode: double
  guard: double
  reason: double

Odometry = Simulink.Bus()
  x: double, Unit="m"
  y: double, Unit="m"
  yaw: double, Unit="rad"
  vx: double, Unit="m/s"
  wz: double, Unit="rad/s"

Imu = Simulink.Bus()
  orientation_yaw: double, Unit="rad"
  angular_velocity_z: double, Unit="rad/s"
  linear_acceleration_x: double, Unit="m/s^2"

NavSatFix = Simulink.Bus()
  latitude: double, Unit="deg"
  longitude: double, Unit="deg"
  altitude: double, Unit="m"

WheelCommand = Simulink.Bus()
  fl: double, Unit="rad/s"
  fr: double, Unit="rad/s"
  rl: double, Unit="rad/s"
  rr: double, Unit="rad/s"

WheelState = Simulink.Bus()
  position: double, Unit="rad"
  velocity: double, Unit="rad/s"
  effort: double, Unit="N*m"

SafetyStatus = Simulink.Bus()
  hw_e_stop_user_button: double
  motor_contactor_engaged: double
  latch_active: double
  latch_cause: double
  link_healthy: double

SafetyCommandEcho = Simulink.Bus()
  sw_e_stop_user_button: double
  sw_e_stop_motor_driver_fault: double
  sw_e_stop_latch_reset: double
  cpu_wdg_heartbeat: double

DriverState = Simulink.Bus()
  fault: double
  temperature: double, Unit="degC"
  current: double, Unit="A"

BatteryState = Simulink.Bus()
  voltage: double, Unit="V"
  current: double, Unit="A"
  percentage: double
  temperature: double, Unit="degC"
  power_supply_health: double

SystemStatus = Simulink.Bus()
  cpu_percent: double
  cpu_temp: double, Unit="degC"
  ram_percent: double
  disk_percent: double

Diagnostics = Simulink.Bus()
  level: double

TriggerService = Simulink.Bus()
  success: double

LedAnimationRequest = Simulink.Bus()
  animation_id: double
  repeating: double

ByteStream = Simulink.Bus()
  length: double, Unit="byte"

ModbusFrame = Simulink.Bus()
  coils: double
  discrete_inputs: double

Transform = Simulink.Bus()
  x: double, Unit="m"
  y: double, Unit="m"
  yaw: double, Unit="rad"