# Requirement set ROVER_ROS_SYS-SR (R2026a)
ROVER-A1 rover_ros platform system requirements, imported from system/ROVER-A1-ROVER_ROS_SYS-SR-V-002.xlsx (the master). Re-run build_requirements after editing the xlsx.

## 1 [SYS-SR-001] Physical: The rover platform shall have a total mass not exceeding 60 kg, including batteries and...
The rover platform shall have a total mass not exceeding 60 kg, including batteries and excluding payload.
Rationale: Limits transport/handling effort and drive-train sizing.
AcceptanceCriteria: Fully assembled platform (with batteries, without payload) weighs <= 60.0 kg on a calibrated scale.
Category: Physical
Comments: Confirm whether payload is included in the 60 kg.
CAD evidence 2026-09-25 (SolidWorks ROVER_1000_WATT_VARIANT): 54.35 kg including batteries, so compliant with a 5.65 kg (9.4%) margin. Final verification is by weighing. See the 'Mass Properties' sheet.
OriginalText: The rover platform should has maximum 60 kg
Priority: Must
Status: Draft
VerificationMethod: Inspection

## 2 [SYS-SR-002] Drive: The rover platform shall control 4 wheel drive joints in velocity mode using encoder fe...
The rover platform shall control 4 wheel drive joints in velocity mode using encoder feedback, at a control rate of at least 50 Hz.
Rationale: Closed-loop wheel velocity control is required for kinematics and odometry.
AcceptanceCriteria: Each of the 4 joints tracks a velocity setpoint; the measured control loop rate is >= 50 Hz over 60 s.
Category: Drive
Comments: 'Continuous joint' is a URDF term. 50 Hz is a proposed value [TBC].
OriginalText: The rover platform should control 4 continuous joints
Priority: Must
Status: Draft
TraceDependsOn: SYS-SR-003
VerificationMethod: Test

## 3 [SYS-SR-003] Drive: The rover platform shall implement skid-steer (differential-drive) kinematics that conv...
The rover platform shall implement skid-steer (differential-drive) kinematics that convert commanded body linear and angular velocity into wheel velocities, and shall publish wheel odometry.
Rationale: Allows motion to be commanded as a body twist and position to be estimated.
AcceptanceCriteria: Driving 10 m straight at 0.5 m/s on flat ground: odometry distance error <= 5% of distance travelled [TBC].
Category: Drive
Comments: Confirm that 'differential kinematics' means differential/skid-steer drive.
OriginalText: The rover platform should implement differential kinematics
Priority: Must
Status: Draft
TraceDependsOn: SYS-SR-002, SYS-SR-021
VerificationMethod: Test

## 4 [SYS-SR-004] Performance: The rover platform shall limit linear velocity to a maximum of 1.0 m/s and angular velo...
The rover platform shall limit linear velocity to a maximum of 1.0 m/s and angular velocity to a maximum of 1.7 rad/s, for commands from any source.
Rationale: Safety speed limit for operation around people.
AcceptanceCriteria: Commands above the limit result in a measured speed <= 1.05 m/s (and <= angular limit) on flat hard ground.
Category: Performance
Comments: Original wording was unclear: capability or limit? Rewritten as a limit. Angular limit TBD.
OriginalText: The rover platform should travel 1 m/s maximum allowed speed
Priority: Must
Status: Draft
TraceDependsOn: SYS-SR-005, SYS-SR-013
VerificationMethod: Test

## 5 [SYS-SR-005] Command: The rover platform shall accept velocity commands from 4 sources ([TBD] e.g. joystick t...
The rover platform shall accept velocity commands from 4 sources ([TBD] e.g. joystick teleoperation, remote/web UI, navigation stack, autonomy/docking) and shall execute only the highest-priority active source.
Rationale: Several operators and subsystems may command the rover; conflicts must be resolved in a known, fixed order.
AcceptanceCriteria: With several sources publishing at the same time, only commands from the highest-priority source are executed.
Category: Command
Comments: The author must name the 4 sources and set their priority order.
OriginalText: The rover platform should receive velocity command from 4 sources
Priority: Must
Status: Draft
TraceDependsOn: SYS-SR-011
VerificationMethod: Test

## 6 [SYS-SR-006] Safety: The rover platform shall have at least [TBD] hardware emergency stop button(s) that, wh...
The rover platform shall have at least [TBD] hardware emergency stop button(s) that, when pressed, remove drive power independently of software (stop category 0 or 1 per IEC 60204-1, ISO 13850).
Rationale: A hardware E-stop must work even if the software has failed.
AcceptanceCriteria: At 1 m/s, pressing the E-stop brings the rover to standstill within SYS-SR-014 distance; motors are unpowered while the computer stays running.
Category: Safety
Comments: Button count, locations and stop category TBD.
OriginalText: The rover platform should has emergency stop button
Priority: Must
Status: Draft
TraceDependsOn: SYS-SR-008, SYS-SR-014, SYS-SR-023
VerificationMethod: Test

## 7 [SYS-SR-007] Safety: The rover platform shall provide a software emergency stop, triggerable through the ROS...
The rover platform shall provide a software emergency stop, triggerable through the ROS interface, that commands zero velocity to all drive joints within 100 ms.
Rationale: Lets remote operators and software monitors stop the rover.
AcceptanceCriteria: Latency from trigger to zero-velocity command <= 100 ms in 20 of 20 trials.
Category: Safety
Comments: 100 ms is a proposed value [TBC].
OriginalText: The rover platform should has software emergency button
Priority: Must
Status: Draft
TraceDependsOn: SYS-SR-008, SYS-SR-023
VerificationMethod: Test

## 8 [SYS-SR-008] Safety: After any emergency stop (hardware or software), the rover platform shall remain stoppe...
After any emergency stop (hardware or software), the rover platform shall remain stopped until an operator performs an explicit reset; releasing the E-stop alone shall not resume motion.
Rationale: Prevents unexpected motion after an E-stop is released.
AcceptanceCriteria: After releasing the E-stop with non-zero commands present, the rover stays still until the reset action is performed.
Category: Safety
Comments: 'Safety latch' is read as a latched stop state. Confirm it doesn't mean a mechanical latch.
OriginalText: The rover platform should has safety latch
Priority: Must
Status: Draft
TraceDependsOn: SYS-SR-006, SYS-SR-007
VerificationMethod: Test

## 9 [SYS-SR-009] HMI: The rover platform shall indicate its current system state on the LED panels according ...
The rover platform shall indicate its current system state on the LED panels according to a defined state-to-LED mapping (colour and pattern for each state in SYS-SR-010).
Rationale: Lets people nearby see the rover's state at a glance.
AcceptanceCriteria: Each state defined in SYS-SR-010 produces its specified LED colour/pattern.
Category: HMI
Comments: The state-to-LED mapping table has to be created.
OriginalText: The rover platform should show states on the led panels
Priority: Should
Status: Draft
TraceDependsOn: SYS-SR-010
VerificationMethod: Demonstration

## 10 [SYS-SR-010] States: The rover platform shall implement a defined system state machine with at least these s...
The rover platform shall implement a defined system state machine with at least these states: Boot, Idle, Teleoperation, Autonomous, Emergency Stop, Fault, Low Battery.
Rationale: SYS-SR-009 and the safety behaviour depend on well-defined states.
AcceptanceCriteria: The state machine is documented; every transition can be triggered and observed.
Category: States
Comments: New. State list to be confirmed.
Priority: Must
Status: Proposed
TraceDependsOn: SYS-SR-009
VerificationMethod: Inspection, Test

## 11 [SYS-SR-011] Safety: The rover platform shall bring itself to a stop if no valid velocity command is receive...
The rover platform shall bring itself to a stop if no valid velocity command is received from the active source within 500 ms.
Rationale: Command watchdog: stops the rover if a source crashes or goes silent.
AcceptanceCriteria: Stopping a command stream at 1 m/s starts deceleration within 500 ms.
Category: Safety
Comments: New. 500 ms is a proposed value.
Priority: Must
Status: Proposed
TraceDependsOn: SYS-SR-005
VerificationMethod: Test

## 12 [SYS-SR-012] Safety: The rover platform shall stop if communication with the operator station is lost for mo...
The rover platform shall stop if communication with the operator station is lost for more than [TBD] s.
Rationale: The rover must not drive on while nobody can supervise it.
AcceptanceCriteria: Disconnecting the network link while moving brings the rover to a stop within the timeout.
Category: Safety
Comments: New.
Priority: Must
Status: Proposed
TraceDependsOn: SYS-SR-025
VerificationMethod: Test

## 13 [SYS-SR-013] Performance: The rover platform shall limit linear acceleration and deceleration to [TBD] m/s^2 and ...
The rover platform shall limit linear acceleration and deceleration to [TBD] m/s^2 and angular acceleration to [TBD] rad/s^2.
Rationale: Prevents tipping, wheel slip and payload damage.
AcceptanceCriteria: Measured acceleration during a step command is <= the limits.
Category: Performance
Comments: New.
Priority: Should
Status: Proposed
TraceDependsOn: SYS-SR-004
VerificationMethod: Test

## 14 [SYS-SR-014] Safety: The rover platform shall stop from 1.0 m/s within [TBD] m on flat, dry, hard ground whe...
The rover platform shall stop from 1.0 m/s within [TBD] m on flat, dry, hard ground when any emergency stop is triggered.
Rationale: Needed to size safety zones around the rover.
AcceptanceCriteria: Measured stopping distance <= limit in 10 of 10 trials.
Category: Safety
Comments: New.
Priority: Must
Status: Proposed
TraceDependsOn: SYS-SR-006, SYS-SR-007
VerificationMethod: Test

## 15 [SYS-SR-015] Power: The rover platform shall operate continuously for at least [TBD] h on a full battery ch...
The rover platform shall operate continuously for at least [TBD] h on a full battery charge under a [TBD] duty cycle.
Rationale: Sets battery capacity and the mission length.
AcceptanceCriteria: Runtime test from 100% charge until the low-battery safe stop is >= the required duration.
Category: Power
Comments: New.
Priority: Must
Status: Proposed
TraceDependsOn: SYS-SR-017
VerificationMethod: Test

## 16 [SYS-SR-016] Power: The rover platform shall publish battery voltage, current and state of charge at 1 Hz o...
The rover platform shall publish battery voltage, current and state of charge at 1 Hz or faster.
Rationale: Needed by operators and for low-battery behaviour.
AcceptanceCriteria: The battery topic is published at >= 1 Hz; values are within 5% of a reference meter.
Category: Power
Comments: New.
Priority: Must
Status: Proposed
TraceDependsOn: SYS-SR-017
VerificationMethod: Test

## 17 [SYS-SR-017] Power: The rover platform shall enter the Low Battery state at [TBD]% state of charge and shal...
The rover platform shall enter the Low Battery state at [TBD]% state of charge and shall perform a safe stop at [TBD]% state of charge.
Rationale: Prevents deep discharge and loss of control.
AcceptanceCriteria: Simulated or real state of charge crossing each threshold triggers the specified behaviour.
Category: Power
Comments: New.
Priority: Must
Status: Proposed
TraceDependsOn: SYS-SR-010, SYS-SR-016
VerificationMethod: Test

## 18 [SYS-SR-018] Power: The rover platform shall support battery charging via [TBD: external connector / dockin...
The rover platform shall support battery charging via [TBD: external connector / docking station] without removing the battery.
Rationale: Practical daily operation.
AcceptanceCriteria: The battery charges to 100% using the specified method.
Category: Power
Comments: New. Charging method TBD.
Priority: Should
Status: Proposed
VerificationMethod: Demonstration

## 19 [SYS-SR-019] Sensors: The rover platform shall include an IMU that publishes orientation, angular velocity an...
The rover platform shall include an IMU that publishes orientation, angular velocity and linear acceleration at 100 Hz or faster.
Rationale: Improves odometry and allows tilt/tip-over detection.
AcceptanceCriteria: The IMU topic is published at >= 100 Hz with valid covariance fields.
Category: Sensors
Comments: New.
Priority: Should
Status: Proposed
TraceDependsOn: SYS-SR-003
VerificationMethod: Test

## 20 [SYS-SR-020] Software: The rover platform software shall be based on ROS 2 [TBD distribution] and shall use ro...
The rover platform software shall be based on ROS 2 [TBD distribution] and shall use ros2_control for the drive hardware interface.
Rationale: Fixes the software baseline and interfaces.
AcceptanceCriteria: Code review confirms the distribution and the ros2_control hardware interface.
Category: Software
Comments: New. ROS 2 distribution TBD.
Priority: Must
Status: Proposed
TraceDependsOn: SYS-SR-002
VerificationMethod: Inspection

## 21 [SYS-SR-021] Software: The rover platform shall follow ROS REP-103 (units and conventions) and REP-105 (coordi...
The rover platform shall follow ROS REP-103 (units and conventions) and REP-105 (coordinate frames: map, odom, base_link).
Rationale: Keeps the rover compatible with standard ROS navigation tools.
AcceptanceCriteria: The TF tree and message units match REP-103/105.
Category: Software
Comments: New.
Priority: Must
Status: Proposed
TraceDependsOn: SYS-SR-003
VerificationMethod: Inspection

## 22 [SYS-SR-022] Software: The rover platform shall publish diagnostic status for drive motors, battery, E-stop ci...
The rover platform shall publish diagnostic status for drive motors, battery, E-stop circuit and sensors on /diagnostics at 1 Hz or faster.
Rationale: Supports fault detection and maintenance.
AcceptanceCriteria: Each listed component appears in /diagnostics at >= 1 Hz; induced faults are reported as ERROR.
Category: Software
Comments: New.
Priority: Should
Status: Proposed
TraceDependsOn: SYS-SR-010
VerificationMethod: Test

## 23 [SYS-SR-023] Safety: The rover platform shall publish the state of the hardware and software emergency stops...
The rover platform shall publish the state of the hardware and software emergency stops on a ROS topic within 100 ms of a change.
Rationale: Operators and software need to know the E-stop state.
AcceptanceCriteria: Latency from E-stop actuation to the topic update is <= 100 ms.
Category: Safety
Comments: New.
Priority: Must
Status: Proposed
TraceDependsOn: SYS-SR-006, SYS-SR-007
VerificationMethod: Test

## 24 [SYS-SR-024] Software: The rover platform shall start all platform software automatically on power-up and reac...
The rover platform shall start all platform software automatically on power-up and reach the Idle state within [TBD] s.
Rationale: The rover must be usable without manual login or setup.
AcceptanceCriteria: Time from power-on to Idle is <= the limit in 5 of 5 trials.
Category: Software
Comments: New.
Priority: Should
Status: Proposed
TraceDependsOn: SYS-SR-010
VerificationMethod: Test

## 25 [SYS-SR-025] Communication: The rover platform shall provide a wireless link to the operator station with a line-of...
The rover platform shall provide a wireless link to the operator station with a line-of-sight range of at least [TBD] m and a round-trip latency of at most [TBD] ms.
Rationale: Required for teleoperation and monitoring.
AcceptanceCriteria: Range and latency are measured in a field test.
Category: Communication
Comments: New.
Priority: Must
Status: Proposed
TraceDependsOn: SYS-SR-012
VerificationMethod: Test

## 26 [SYS-SR-026] Physical: The rover platform shall not exceed [TBD] x [TBD] x [TBD] mm (L x W x H).
The rover platform shall not exceed [TBD] x [TBD] x [TBD] mm (L x W x H).
Rationale: Must fit through doors and in transport vehicles.
AcceptanceCriteria: The measured dimensions are within the limits.
Category: Physical
Comments: New.
Priority: Should
Status: Proposed
TraceDependsOn: SYS-SR-001
VerificationMethod: Inspection

## 27 [SYS-SR-027] Physical: The rover platform shall carry a payload of at least [TBD] kg while still meeting SYS-S...
The rover platform shall carry a payload of at least [TBD] kg while still meeting SYS-SR-004 and SYS-SR-014.
Rationale: Defines what the platform is useful for.
AcceptanceCriteria: Speed and stopping tests pass with the rated payload fitted.
Category: Physical
Comments: New.
Priority: Must
Status: Proposed
TraceDependsOn: SYS-SR-004, SYS-SR-014
VerificationMethod: Test

## 28 [SYS-SR-028] Environment: The rover platform shall operate on slopes up to [TBD] degrees on [TBD] terrain types.
The rover platform shall operate on slopes up to [TBD] degrees on [TBD] terrain types.
Rationale: Defines the operating domain.
AcceptanceCriteria: The rover climbs, descends and holds position on the specified slope.
Category: Environment
Comments: New.
Priority: Should
Status: Proposed
VerificationMethod: Test

## 29 [SYS-SR-029] Environment: The rover platform shall operate at ambient temperatures from [TBD] to [TBD] degC and s...
The rover platform shall operate at ambient temperatures from [TBD] to [TBD] degC and shall meet ingress protection IP[TBD].
Rationale: Defines the environmental envelope for outdoor use.
AcceptanceCriteria: Environmental test or supplier datasheet analysis.
Category: Environment
Comments: New.
Priority: Should
Status: Proposed
VerificationMethod: Test, Analysis