# Requirement set SWRS_BRG (R2026a)
rover_bringup Software Requirements Specification (ROVER-A1-ROVER_BRINGUP-SWRS-V-001). rover_bringup holds the top-level launch files that start the Rover A1 platform software on real hardware. rover_bringup.launch.py gates start-up on the hardware-configuration flag, checks the OS build version, starts rover_controller (ros2_control) and rover_diag_manager first, and starts battery, LED, safety, localization, CRSF teleop and twist_mux once the controllers are active. rover_web_bridges.launch.py starts foxglove_bridge (with topic/service whitelists), rosbridge and rosapi for the web UIs and ros-mcp. Automatic start at power-up is done by the rover_docker container start script, outside this package boundary; the GPS and lidar drivers belong to the sensor payload (rover_sensors). Simulation uses rover_gazebo instead.

## 1 [SWR-BRG-001] Lifecycle: The rover_bringup shall start the platform stack only when the environment variable ROB...
The rover_bringup shall start the platform stack only when the environment variable ROBOT_HW_CONFIG_CORRECT is true (default true); otherwise it shall log INCORRECT_HW_CONFIG, start no platform node, and keep the launch process alive unless exit_on_wrong_hw is true.
Rationale: Prevents driving motors with a mismatched hardware configuration while keeping the container up for diagnosis.
AcceptanceCriteria: With ROBOT_HW_CONFIG_CORRECT=false, `ros2 launch rover_bringup rover_bringup.launch.py` logs the INCORRECT_HW_CONFIG error, `ros2 node list` shows no rover_* node after 30 s, and the launch is still running; with exit_on_wrong_hw:=true it exits.
Category: Lifecycle
Comments: Keeping alive is done with `sleep infinity` (rover_bringup.launch.py:234-237). No automated test.
Evidence: rover_bringup/launch/rover_bringup.launch.py:232-245; rover_bringup/launch/rover_bringup.launch.py:281-288; rover_bringup/README.md:19-21
Implementation: Implemented
ParentSysSR: SYS-SR-024
Priority: Must
Status: As-Built
VerificationMethod: Test

## 2 [SWR-BRG-002] Diagnostics: The rover_bringup shall log a warning when SYSTEM_BUILD_VERSION (default v1.0.0) is low...
The rover_bringup shall log a warning when SYSTEM_BUILD_VERSION (default v1.0.0) is lower than the minimum OS version v1.0.0, and continue the start-up.
Rationale: Makes an outdated OS image visible without blocking operation.
AcceptanceCriteria: With SYSTEM_BUILD_VERSION=v0.9.0 the launch prints the INCORRECT_OS_VERSION warning including 'required: v1.0.0' and the stack still starts.
Category: Diagnostics
DerivedRationale: Technical deployment check of the OS image.
Evidence: rover_bringup/launch/rover_bringup.launch.py:44; rover_bringup/launch/rover_bringup.launch.py:247-261; rover_utils/rover_utils/version_check.py:24-29
Implementation: Implemented
Priority: Could
Status: As-Built
VerificationMethod: Inspection, Demonstration

## 3 [SWR-BRG-003] Functional: The rover_bringup shall start rover_controller (robot description, controller_manager a...
The rover_bringup shall start rover_controller (robot description, controller_manager and the ros2_control controllers) with use_sim False as the first stage of the platform stack.
Rationale: SYS-SR-020 requires ros2_control for the drive hardware interface; the drive must be up before its consumers.
AcceptanceCriteria: After launch on hardware, `ros2 control list_controllers` shows the rover controllers active.
Category: Functional
Evidence: rover_bringup/launch/rover_bringup.launch.py:112-127; rover_bringup/launch/rover_bringup.launch.py:281-288
Implementation: Implemented
ParentSysSR: SYS-SR-020, SYS-SR-002
Priority: Must
Status: As-Built
VerificationMethod: Demonstration

## 4 [SWR-BRG-004] Functional: The rover_bringup shall start rover_diag_manager (system diagnostics and the diagnostic...
The rover_bringup shall start rover_diag_manager (system diagnostics and the diagnostic aggregator) together with rover_controller in the first stage.
Rationale: Diagnostics must be available from the start to report failures of later stages (SYS-SR-022).
AcceptanceCriteria: rover_diag_manager_node and rover_diagnostic_aggregator appear in `ros2 node list` before the second-stage nodes.
Category: Functional
Comments: Passes use_sim and common_dir_path to system_diag.launch.py, which does not declare them (ignored).
Evidence: rover_bringup/launch/rover_bringup.launch.py:129-145; rover_bringup/launch/rover_bringup.launch.py:281-285
Implementation: Implemented
ParentSysSR: SYS-SR-022
Priority: Should
Status: As-Built
VerificationMethod: Demonstration

## 5 [SWR-BRG-005] Lifecycle: The rover_bringup shall start rover_battery, rover_led, rover_safety, rover_localizatio...
The rover_bringup shall start rover_battery, rover_led, rover_safety, rover_localization, rover_crsf_teleop and rover_twist_mux exactly once, when rover_controller emits the ControllersActive event (after the rover_imu_broadcaster spawner succeeds) or after controllers_ready_timeout seconds (default 20.0) with a warning if the event never arrives.
Rationale: Consumers of joint states, odometry and IMU must not start before the controllers are active; the timeout covers a hung spawner.
AcceptanceCriteria: In the launch log the second-stage nodes start after 'rover_imu_broadcaster' is spawned; with the event suppressed they start 20 s after launch and the warning 'rover_controller did not report its controllers active within controllers_ready_timeout' is printed once.
Category: Lifecycle
Comments: A failed spawner shuts the whole launch down (README.md:36-37).
Evidence: rover_bringup/launch/rover_bringup.launch.py:97-105; rover_bringup/launch/rover_bringup.launch.py:266-279; rover_utils/rover_utils/events.py:38-66; rover_controller/launch/rover_controller.launch.py:314-321
Implementation: Implemented
ParentSysSR: SYS-SR-024
Priority: Must
Status: As-Built
VerificationMethod: Demonstration, Inspection

## 6 [SWR-BRG-006] Safety: The rover_bringup shall start rover_safety in the second stage unless the launch argume...
The rover_bringup shall start rover_safety in the second stage unless the launch argument disable_manager is True (default False).
Rationale: rover_safety implements the software E-stop handling and state/LED logic (SYS-SR-007, SYS-SR-008, SYS-SR-010).
AcceptanceCriteria: With default arguments rover_safety_node is running after start-up; with disable_manager:=True it is absent.
Category: Safety
Comments: disable_manager:=True silently removes the safety manager on hardware; no warning is logged. Argument description still says 'manager_bt_node' (line 67). Consider logging a warning or forbidding it on hardware [TBC].
Evidence: rover_bringup/launch/rover_bringup.launch.py:163-175; rover_bringup/launch/rover_bringup.launch.py:63-69
Implementation: Implemented
ParentSysSR: SYS-SR-007, SYS-SR-008, SYS-SR-010
Priority: Must
Status: As-Built
VerificationMethod: Demonstration

## 7 [SWR-BRG-007] Functional: The rover_bringup shall start rover_localization with use_ekf True and fuse_gps set fro...
The rover_bringup shall start rover_localization with use_ekf True and fuse_gps set from the use_gps argument (default $ROVER_SYSTEM_USE_GPS, else false).
Rationale: The fused odometry is required on hardware; GPS fusion is selected per deployment.
AcceptanceCriteria: With ROVER_USE_GPS unset only rover_ekf_node runs; with ROVER_USE_GPS=true rover_ekf_global_node, rover_navsat_transform_node and rover_gps_heading_node also run.
Category: Functional
Evidence: rover_bringup/launch/rover_bringup.launch.py:90-95; rover_bringup/launch/rover_bringup.launch.py:147-161
Implementation: Implemented
ParentSysSR: SYS-SR-003, SYS-SR-021
Priority: Must
Status: As-Built
VerificationMethod: Demonstration

## 8 [SWR-BRG-008] Parameter: The rover_bringup shall pass namespace (default $ROVER_SYSTEM_NAMESPACE, else empty), l...
The rover_bringup shall pass namespace (default $ROVER_SYSTEM_NAMESPACE, else empty), log_level (DEBUG/INFO/WARN/ERROR/FATAL, default INFO) and common_dir_path (default empty) to every included launch file.
Rationale: One namespace and log level for the whole platform; per-package config overrides from a common directory.
AcceptanceCriteria: Every IncludeLaunchDescription in rover_bringup.launch.py passes namespace, log_level and common_dir_path; with ROVER_NAMESPACE=rover all platform nodes are under /rover.
Category: Parameter
DerivedRationale: Technical launch interface enabling namespaced multi-robot deployment.
Evidence: rover_bringup/launch/rover_bringup.launch.py:56-61; rover_bringup/launch/rover_bringup.launch.py:71-84; rover_bringup/launch/rover_bringup.launch.py:121-126
Implementation: Implemented
Priority: Should
Status: As-Built
VerificationMethod: Inspection

## 9 [SWR-BRG-009] Build: The rover_bringup shall declare run dependencies on rover_controller, rover_localizatio...
The rover_bringup shall declare run dependencies on rover_controller, rover_localization, rover_diag_manager, rover_twist_mux, rover_crsf_teleop, rover_battery, rover_utils, rover_safety, rover_led, rover_udp_driver, foxglove_bridge, rosbridge_server and rmw_zenoh_cpp for the hardware build type (ROVER_ROS_BUILD_TYPE == hardware).
Rationale: rosdep must install everything the hardware launch starts, including the Zenoh RMW.
AcceptanceCriteria: `rosdep check --from-paths src/rover_ros/rover_bringup` with ROVER_ROS_BUILD_TYPE=hardware resolves all listed packages.
Category: Build
Evidence: rover_bringup/package.xml:12-34
Implementation: Implemented
ParentSysSR: SYS-SR-020
Priority: Should
Status: As-Built
VerificationMethod: Inspection

## 10 [SWR-BRG-010] Build: The rover_bringup shall run on the ROS 2 distribution fixed in SYS-SR-020 with rmw_zeno...
The rover_bringup shall run on the ROS 2 distribution fixed in SYS-SR-020 with rmw_zenoh_cpp as the RMW implementation.
Rationale: SYS-SR-020 leaves the distribution [TBD]; the workspace is set up for ROS 2 Lyrical and Zenoh.
AcceptanceCriteria: On the rover, ROS_DISTRO equals the SYS-SR-020 value and RMW_IMPLEMENTATION=rmw_zenoh_cpp in the platform container.
Category: Build
Comments: SYS-SR-020 distribution is [TBD]; the workspace README uses ROS_DISTRO=lyrical. The RMW is set by the environment (setup script / container), not by rover_bringup itself. Update SYS-SR-020 to 'Lyrical' [TBC].
Evidence: README.md:88; rover_scripts/setup_rover_pc.sh:104; rover_bringup/package.xml:34
Implementation: Partial
ParentSysSR: SYS-SR-020
Priority: Must
Status: As-Built
VerificationMethod: Inspection

## 11 [SWR-BRG-011] Lifecycle: The rover_bringup shall be started automatically at power-up and bring the platform to ...
The rover_bringup shall be started automatically at power-up and bring the platform to the Idle state within [TBD per SYS-SR-024] s.
Rationale: SYS-SR-024 requires automatic start and a bounded time to Idle.
AcceptanceCriteria: Time from power-on to the Idle state being reported is <= [TBD per SYS-SR-024] s in 5 of 5 trials.
Category: Lifecycle
Comments: Auto-start is provided outside this boundary by the rover_docker container (rovera1-app start.sh). No 'Idle' state is defined or reported anywhere in the bringup, and no start-up time is measured; the only bound is the 20.0 s controllers_ready_timeout fallback. Needs a state-publishing node (SYS-SR-010) and a boot-time test.
Evidence: rover_bringup/README.md:10-11; rover_bringup/launch/rover_bringup.launch.py:266-288
Implementation: Gap
ParentSysSR: SYS-SR-024
Priority: Should
Status: Proposed
VerificationMethod: Test

## 12 [SWR-BRG-012] Interface: The rover_bringup shall start foxglove_bridge as node rover_foxglove_bridge (WebSocket ...
The rover_bringup shall start foxglove_bridge as node rover_foxglove_bridge (WebSocket port 8765, upstream default) with sysinfo disabled and an asset URI allowlist accepting package:// URIs of the upstream mesh/image extensions in any letter case.
Rationale: Foxglove, the drive UI and the Cockpit diagnostics page connect through this bridge; upper-case mesh extensions must load.
AcceptanceCriteria: `ros2 launch rover_bringup rover_web_bridges.launch.py` creates node rover_foxglove_bridge listening on TCP 8765 and no /foxglove_bridge/sysinfo topic is published.
Category: Interface
Comments: Port 8765 is the upstream foxglove_bridge default, stated in README.md:72, not set in the launch file. The web bridges are started by rover_docker start.sh next to the bringup, not by rover_bringup.launch.py.
Evidence: rover_bringup/launch/rover_web_bridges.launch.py:34-42; rover_bringup/launch/rover_web_bridges.launch.py:159-181; rover_bringup/README.md:72
Implementation: Implemented
ParentSysSR: SYS-SR-025
Priority: Should
Status: As-Built
VerificationMethod: Inspection, Demonstration

## 13 [SWR-BRG-013] Performance: The rover_bringup shall restrict foxglove_bridge to the whitelisted topics (/tf, /tf_st...
The rover_bringup shall restrict foxglove_bridge to the whitelisted topics (/tf, /tf_static and the listed UI topics under any namespace) and to the whitelisted services, unless ROVER_PLATFORM_FOXGLOVE_TOPIC_WHITELIST or ROVER_PLATFORM_FOXGLOVE_SERVICE_WHITELIST is set non-empty.
Rationale: Anything a browser subscribes to crosses the Zenoh router at full rate; unknown services caused log floods. Topics a UI only publishes must still be listed or its client sends nothing.
AcceptanceCriteria: test_web_bridges_whitelist.py passes: UI-published and UI-subscribed topics and UI services are allowed under /rover, /rover_a2 and no namespace; internal topics and other services are rejected.
Category: Performance
Comments: The whitelist includes the E-stop set/reset services (lines 112-114), so the web UI can trigger the software E-stop (SYS-SR-007) through the bridge.
Evidence: rover_bringup/launch/rover_web_bridges.launch.py:54-95; rover_bringup/launch/rover_web_bridges.launch.py:106-149; rover_bringup/launch/rover_web_bridges.launch.py:172-175
Implementation: Implemented
ParentSysSR: SYS-SR-025
Priority: Should
Status: As-Built
VerificationMethod: Test
VerifiedBy: rover_bringup/test/test_web_bridges_whitelist.py

## 14 [SWR-BRG-014] Interface: The rover_bringup shall start rosbridge_websocket as node rover_rosbridge_websocket (po...
The rover_bringup shall start rosbridge_websocket as node rover_rosbridge_websocket (port 9090, upstream default) and rosapi_node as /rosapi.
Rationale: ros-mcp-server and other rosbridge clients use port 9090 and the /rosapi/* services.
AcceptanceCriteria: After launching rover_web_bridges.launch.py, TCP 9090 accepts a rosbridge WebSocket connection and `ros2 service list` contains /rosapi/get_time.
Category: Interface
Comments: The bridges are not namespaced and see the whole graph (README.md:76).
Evidence: rover_bringup/launch/rover_web_bridges.launch.py:183-198; rover_bringup/README.md:73-74
Implementation: Implemented
ParentSysSR: SYS-SR-025
Priority: Could
Status: As-Built
VerificationMethod: Demonstration

## 15 [SWR-BRG-015] Lifecycle: The rover_bringup shall have an automated launch test that verifies the two-stage start...
The rover_bringup shall have an automated launch test that verifies the two-stage start order and that all platform nodes are running after start-up.
Rationale: Start-up order and completeness (SYS-SR-024) are currently checked only by hand.
AcceptanceCriteria: A launch_testing test under rover_bringup/test passes with mocked hardware, asserting that second-stage nodes start only after ControllersActive (or the timeout) and that all expected nodes are present.
Category: Lifecycle
Comments: The only test is the foxglove whitelist unit test.
Evidence: rover_bringup/CMakeLists.txt:8-12
Implementation: Gap
ParentSysSR: SYS-SR-024
Priority: Could
Status: Proposed
VerificationMethod: Test