# Requirement set SWRS_CRSF (R2026a)
rover_crsf_teleop Software Requirements Specification (ROVER-A1-ROVER_CRSF_TELEOP-SWRS-V-001). rover_crsf_teleop provides line-of-sight RC teleoperation over an ExpressLRS/CRSF receiver. The receiver is wired through a USB-UART adapter to the RUTX11 router, whose Serial Utilities (Over IP: UDP client, raw mode, 460800 8N1) forward the raw CRSF bytes as UDP datagrams to 192.168.1.201:10111. A lifecycle component (RoverCrsfTeleopNode) decodes that byte stream as published by rover_udp_driver's UdpReceiverNode (rover_crsf_udp_receiver, accepting datagrams from the router, 192.168.1.1, only; both in one single-threaded container), maps two stick channels to TwistStamped commands on the highest-priority twist_mux input (teleop_elrs_cmd_vel_stamped) at 50 Hz, maps two switch channels onto the hardware interface's software E-Stop set/reset and latch-reset services, applies an RC-link failsafe (zero burst then silence), and offers an E-Stop-interlocked per-channel stick calibration with persistence.

## 1 [SWR-CRSF-001] Interface: The rover_crsf_teleop shall subscribe the raw CRSF byte stream as udp_msgs/UdpPacket da...
The rover_crsf_teleop shall subscribe the raw CRSF byte stream as udp_msgs/UdpPacket datagrams on udp_topic (rc/raw_udp) with QoS depth 100, reliable, from the moment it is configured, and shall feed each datagram's data to the stream CRSF parser without assuming that datagram boundaries coincide with CRSF frame boundaries.
Rationale: A dropped byte chunk desynchronises the parser until the next sync byte, so the ROS hop must not drop it; decoding while inactive means link health is known the moment teleop is activated. The router cuts datagrams on its serial timeout, not on CRSF frames, so a frame can span two datagrams.
AcceptanceCriteria: Code review shows QoS(100) (reliable) created in on_configure; the integration tests drive the node with encoded CRSF bytes as UdpPacket datagrams on rc/raw_udp, including frames split across datagrams (FramesSplitAcrossDatagramsAreDecoded).
Category: Interface
Evidence: rover_crsf_teleop/src/infrastructure/rover_crsf_teleop_node.cpp:493-527; rover_crsf_teleop/src/infrastructure/rover_crsf_teleop_node.cpp:198; rover_crsf_teleop/config/rover_crsf_teleop.yaml:26-30
Implementation: Implemented
ParentSysSR: SYS-SR-005
Priority: Must
Status: As-Built
VerificationMethod: Inspection, Test
VerifiedBy: rover_crsf_teleop/test/integration/test_teleop_node.cpp; rover_crsf_teleop/test/test_launch_structure.py

## 2 [SWR-CRSF-002] Functional: The rover_crsf_teleop shall decode CRSF RC_CHANNELS_PACKED (0x16, 16 x 11-bit channels)...
The rover_crsf_teleop shall decode CRSF RC_CHANNELS_PACKED (0x16, 16 x 11-bit channels) and LINK_STATISTICS (0x14) frames addressed to the flight controller (0xC8), discard frames with a bad CRC8 or out-of-range length byte, and resynchronise on the next sync byte with a bounded buffer.
Rationale: Only CRC-valid frames may drive the rover; corrupted input must never be interpreted as stick positions.
AcceptanceCriteria: Parser unit tests pass: all-channel decode, full 11-bit range, split/merged chunks, garbage resync, bad CRC dropped with the next good frame decoded, bounded buffer, random bytes survived.
Category: Functional
Evidence: rover_crsf_teleop/include/rover_crsf_teleop/domain/crsf/crsf_protocol.hpp:42-46; rover_crsf_teleop/src/domain/crsf/crsf_parser.cpp:116-120; rover_crsf_teleop/src/domain/crsf/crsf_parser.cpp:142-167; rover_crsf_teleop/src/domain/crsf/crsf_parser.cpp:206-211
Implementation: Implemented
ParentSysSR: SYS-SR-005
Priority: Must
Status: As-Built
VerificationMethod: Test
VerifiedBy: rover_crsf_teleop/test/unit/test_crsf_parser.cpp; rover_crsf_teleop/test/unit/test_crc8.cpp

## 3 [SWR-CRSF-003] Interface: The rover_crsf_teleop shall publish velocity commands as geometry_msgs/TwistStamped wit...
The rover_crsf_teleop shall publish velocity commands as geometry_msgs/TwistStamped with header.frame_id base_link on teleop_elrs_cmd_vel_stamped through a lifecycle publisher (depth 10) that is active only while the node is ACTIVE.
Rationale: This is the cmd_elrs input of rover_twist_mux (priority 110); a lifecycle publisher guarantees an inactive node cannot command motion.
AcceptanceCriteria: While ACTIVE with a deflected stick, TwistStamped messages with frame_id base_link appear on teleop_elrs_cmd_vel_stamped; while INACTIVE none appear.
Category: Interface
Evidence: rover_crsf_teleop/src/infrastructure/rover_crsf_teleop_node.cpp:40-41; rover_crsf_teleop/src/infrastructure/rover_crsf_teleop_node.cpp:423-424; rover_crsf_teleop/src/infrastructure/ros2_velocity_command_publisher.cpp:26-48; rover_twist_mux/config/rover_twist_mux.yaml:21-24
Implementation: Implemented
ParentSysSR: SYS-SR-005
Priority: Must
Status: As-Built
VerificationMethod: Test, Inspection
VerifiedBy: rover_crsf_teleop/test/integration/test_teleop_node.cpp

## 4 [SWR-CRSF-004] Performance: The rover_crsf_teleop shall run its control loop every 20 ms (50 Hz) while ACTIVE and p...
The rover_crsf_teleop shall run its control loop every 20 ms (50 Hz) while ACTIVE and publish one command per tick while the sticks are deflected and the link is healthy.
Rationale: 50 Hz keeps the cmd_elrs input far inside the 0.5 s twist_mux timeout and the 500 ms command watchdog.
AcceptanceCriteria: With a steady deflected stick, one command is published per 20 ms control tick ('ros2 topic hz teleop_elrs_cmd_vel_stamped' reports 50 Hz).
Category: Performance
Comments: The tests check one publish per tick, not the wall-clock rate; a rate tolerance is TBD.
Evidence: rover_crsf_teleop/src/infrastructure/rover_crsf_teleop_node.cpp:44; rover_crsf_teleop/src/infrastructure/rover_crsf_teleop_node.cpp:809; rover_crsf_teleop/src/application/teleop_use_case.cpp:96-103
Implementation: Implemented
ParentSysSR: SYS-SR-011
Priority: Must
Status: As-Built
VerificationMethod: Test
VerifiedBy: rover_crsf_teleop/test/unit/test_teleop_use_case.cpp; rover_crsf_teleop/test/integration/test_teleop_node.cpp

## 5 [SWR-CRSF-005] Functional: The rover_crsf_teleop shall map linear_x_channel (3) to linear.x in [-0.95, 0.95] m/s a...
The rover_crsf_teleop shall map linear_x_channel (3) to linear.x in [-0.95, 0.95] m/s and angular_z_channel (1, inverted) to angular.z in [-1.5, 1.5] rad/s, clamping raw values to the channel's calibrated range and mapping a stick within channel_deadband (30 counts) of its midpoint to exactly 0.0.
Rationale: Output limits match the drive controller caps; an exact zero at centre is required by the hardware interface's E-Stop reset invariant and by the zero-burst logic.
AcceptanceCriteria: Stick at each endpoint yields exactly the configured out_min/out_max; any raw value within +/-30 counts of the midpoint yields 0.0; out-of-range raw values are clamped.
Category: Functional
Comments: 0.95 m/s and 1.5 rad/s are within the SYS-SR-004 limits (1.0 m/s, 1.7 rad/s).
Evidence: rover_crsf_teleop/config/rover_crsf_teleop.yaml:113-121; rover_crsf_teleop/config/rover_crsf_teleop.yaml:70; rover_crsf_teleop/src/domain/stick_mapping.cpp:26-31; rover_crsf_teleop/src/domain/stick_mapping.cpp:50-54
Implementation: Implemented
ParentSysSR: SYS-SR-004, SYS-SR-005
Priority: Must
Status: As-Built
VerificationMethod: Test
VerifiedBy: rover_crsf_teleop/test/unit/test_stick_mapping.cpp

## 6 [SWR-CRSF-006] Functional: The rover_crsf_teleop shall shape each stick axis as (1 - e) * m + e * m^3 of the norma...
The rover_crsf_teleop shall shape each stick axis as (1 - e) * m + e * m^3 of the normalised deflection m, with e = linear_x_expo (0.3) and angular_z_expo (0.5), clamping e to [0, 1] and keeping full deflection at the output limits.
Rationale: Finer low-speed control, matching the web joystick.
AcceptanceCriteria: Expo 0 equals the linear mapping; full throw still reaches out_min/out_max; half throw is softer than linear; an out-of-range expo is clamped.
Category: Functional
DerivedRationale: Operator-handling refinement with no system-level parent.
Evidence: rover_crsf_teleop/config/rover_crsf_teleop.yaml:128-129; rover_crsf_teleop/src/domain/stick_mapping.cpp:43-46
Implementation: Implemented
Priority: Could
Status: As-Built
VerificationMethod: Test
VerifiedBy: rover_crsf_teleop/test/unit/test_stick_mapping.cpp

## 7 [SWR-CRSF-007] Performance: The rover_crsf_teleop shall scale linear.x and angular.z by the same factor so that |v|...
The rover_crsf_teleop shall scale linear.x and angular.z by the same factor so that |v| + |w| * effective_track_width / 2 does not exceed max_wheel_rim_speed (1.7 m/s with effective_track_width 1.0204 m).
Rationale: Keeps the outer-wheel speed under the URDF wheel limit while preserving the commanded arc.
AcceptanceCriteria: Full forward plus full turn produces a command whose rim speed equals 1.7 m/s (within floating-point tolerance) with the v/w ratio unchanged; commands within budget are unchanged.
Category: Performance
Comments: effective_track_width must be updated with wheel_separation_multiplier in rover_controller (config comment).
Evidence: rover_crsf_teleop/config/rover_crsf_teleop.yaml:131-138; rover_crsf_teleop/src/domain/rim_speed_limit.cpp:25-35; rover_crsf_teleop/src/application/teleop_use_case.cpp:99
Implementation: Implemented
ParentSysSR: SYS-SR-004
Priority: Should
Status: As-Built
VerificationMethod: Test
VerifiedBy: rover_crsf_teleop/test/unit/test_rim_speed_limit.cpp; rover_crsf_teleop/test/unit/test_teleop_use_case.cpp

## 8 [SWR-CRSF-008] Parameter: The rover_crsf_teleop shall declare linear_x_out_min/max and angular_z_out_min/max defa...
The rover_crsf_teleop shall declare linear_x_out_min/max and angular_z_out_min/max defaults no larger in magnitude than 1.0 m/s and 1.7 rad/s and shall refuse to configure with values beyond those limits.
Rationale: The declared defaults (+/-2.0 m/s, +/-5.0 rad/s) exceed the system velocity limits, so running without the shipped YAML would command beyond SYS-SR-004; configure validation does not check the limits.
AcceptanceCriteria: Starting the node without a parameter file gives |out| <= 1.0 m/s and <= 1.7 rad/s; configuring with linear_x_out_max = 1.5 fails the configure transition.
Category: Parameter
Comments: Downstream diff_drive limits (rover_controller) still clip, so this is defence in depth. Other code defaults also differ from the shipped YAML (zero_burst_duration_ms 0 vs 300, rc_channels_expected_hz 50 vs 250, expo 0 vs 0.3/0.5).
Evidence: rover_crsf_teleop/src/infrastructure/rover_crsf_teleop_node.cpp:153-159; rover_crsf_teleop/src/application/teleop_config_validation.cpp:117-139
Implementation: Deviation
ParentSysSR: SYS-SR-004
Priority: Should
Status: Proposed
VerificationMethod: Test, Inspection

## 9 [SWR-CRSF-009] Safety: The rover_crsf_teleop shall, when the commanded velocity becomes zero (stick released, ...
The rover_crsf_teleop shall, when the commanded velocity becomes zero (stick released, link lost or teleop inhibited), publish zero commands for zero_burst_duration_ms (300 ms) and then publish nothing until a non-zero command is produced.
Rationale: A burst rather than a single zero means one lost message cannot leave the last motion command standing; going silent lets twist_mux fall through to the next source.
AcceptanceCriteria: After a deflected stick is released, zeros are published for 300 ms (15 ticks) and then no further message until the stick is deflected again; a deflection mid-burst is published at once.
Category: Safety
Evidence: rover_crsf_teleop/config/rover_crsf_teleop.yaml:140-144; rover_crsf_teleop/src/application/teleop_use_case.cpp:126-147
Implementation: Implemented
ParentSysSR: SYS-SR-011, SYS-SR-012
Priority: Must
Status: As-Built
VerificationMethod: Test
VerifiedBy: rover_crsf_teleop/test/unit/test_teleop_use_case.cpp; rover_crsf_teleop/test/integration/test_teleop_node.cpp

## 10 [SWR-CRSF-010] Safety: The rover_crsf_teleop shall judge the RC link healthy only while an RC channels frame w...
The rover_crsf_teleop shall judge the RC link healthy only while an RC channels frame was decoded within channel_timeout_ms (200 ms) and, with require_link_stats true, a LINK_STATISTICS frame was decoded within link_stats_timeout_ms (1000 ms) and uplink link quality has not fallen below link_quality_lost_below (30 %) since it was last at or above link_quality_recovered_at (50 %); the link shall be unhealthy before any input.
Rationale: Frame freshness alone cannot detect a receiver in failsafe that keeps sending held channel values; link quality with hysteresis can, without flapping.
AcceptanceCriteria: Link monitor unit tests: unhealthy before input; unhealthy 200 ms after the last channels frame; unhealthy 1000 ms after the last link-stats frame; LQ 29 -> lost, 30..49 keeps the previous state, 50 -> recovered.
Category: Safety
Comments: Config marks these as INITIAL VALUES to be tuned on the rover (rover_crsf_teleop.yaml:177-180).
Evidence: rover_crsf_teleop/config/rover_crsf_teleop.yaml:181-185; rover_crsf_teleop/src/domain/link_monitor.cpp:64-105; rover_crsf_teleop/include/rover_crsf_teleop/domain/link_monitor.hpp:109
Implementation: Implemented
ParentSysSR: SYS-SR-012, SYS-SR-025
Priority: Must
Status: As-Built
VerificationMethod: Test
VerifiedBy: rover_crsf_teleop/test/unit/test_link_monitor.cpp

## 11 [SWR-CRSF-011] Safety: The rover_crsf_teleop shall, when the RC link is judged lost while ACTIVE, command zero...
The rover_crsf_teleop shall, when the RC link is judged lost while ACTIVE, command zero velocity (SWR-CRSF-009 burst), stop publishing and ignore the switch channels until the link is healthy again, without triggering the E-Stop.
Rationale: Loss of the RC operator link must stop RC-commanded motion at once; twist_mux then falls through to the next source.
AcceptanceCriteria: Stopping the byte stream while driving: a zero is published within channel_timeout_ms (200 ms) + one control period (20 ms) of the last frame, followed by silence; switch changes during the loss call no service; no E-Stop service is called by the loss itself.
Category: Safety
Comments: SYS-SR-012 timeout is [TBD per SYS-SR-012]. Worst-case detection is 200 ms for lost frames but up to 1000 ms when only link statistics stop. Link loss does not stop the rover if a lower-priority source is still commanding (by design of SYS-SR-005 arbitration). Silence on the UDP path (RUTX11 reboot or reload, pulled receiver, adapter or RPi-router cable, stopped UDP receiver) stops the frames in the same way, so it is handled as RC link loss: zero burst and fall-through, not an E-Stop (rover_crsf_teleop_node.cpp:64-68; README.md:61-63).
Evidence: rover_crsf_teleop/src/application/teleop_use_case.cpp:91-94; rover_crsf_teleop/src/application/teleop_use_case.cpp:101; rover_crsf_teleop/README.md:101-106
Implementation: Implemented
ParentSysSR: SYS-SR-012
Priority: Must
Status: As-Built
VerificationMethod: Test
VerifiedBy: rover_crsf_teleop/test/unit/test_teleop_use_case.cpp; rover_crsf_teleop/test/integration/test_teleop_node.cpp

## 12 [SWR-CRSF-012] Safety: The rover_crsf_teleop shall, on a change of the e_stop_channel (5) switch position, cal...
The rover_crsf_teleop shall, on a change of the e_stop_channel (5) switch position, call hardware_interface/sw_user_e_stop_set (std_srvs/Trigger) when it goes low and hardware_interface/sw_user_e_stop_reset when it goes high, and shall call hardware_interface/sw_e_stop_latch_reset when e_stop_latch_reset_channel (4) goes low, evaluated within one 20 ms control tick of the decoded frame.
Rationale: Gives the RC operator a software E-Stop and an explicit, deliberate reset action; only changes fire, never a resting position.
AcceptanceCriteria: Toggling channel 5 low/high produces exactly one set/reset request per edge; channel 4 low produces one latch-reset request; no request fires while the switches rest.
Category: Safety
Comments: The 100 ms SYS-SR-007 budget ends at the hardware interface; this package contributes one tick plus the async service round trip. Switches are only evaluated while the node is ACTIVE and the link is healthy.
Evidence: rover_crsf_teleop/config/rover_crsf_teleop.yaml:146-150; rover_crsf_teleop/src/application/teleop_use_case.cpp:176-193; rover_crsf_teleop/src/infrastructure/ros2_trigger_safety_switch.cpp:40-44
Implementation: Implemented
ParentSysSR: SYS-SR-007, SYS-SR-008
Priority: Must
Status: As-Built
VerificationMethod: Test
VerifiedBy: rover_crsf_teleop/test/unit/test_teleop_use_case.cpp; rover_crsf_teleop/test/integration/test_teleop_node.cpp

## 13 [SWR-CRSF-013] Safety: The rover_crsf_teleop shall ignore switch positions for switch_settle_frames (100 ticks...
The rover_crsf_teleop shall ignore switch positions for switch_settle_frames (100 ticks = 2 s) after start-up and after a calibration inhibit is released, learning the resting position without firing a service call, and shall classify a raw value below channel_switch_threshold (500) as low.
Rationale: Prevents a spurious E-Stop set/reset from the switch's resting position or from switches moved during a calibration sweep.
AcceptanceCriteria: No safety service call during the first 100 ticks regardless of switch position; after re-arm the first frame is not treated as an edge; a value equal to the threshold counts as high.
Category: Safety
Comments: An E-Stop switch already low at boot is learned as the resting position and does not set the E-Stop (edge-only semantics).
Evidence: rover_crsf_teleop/config/rover_crsf_teleop.yaml:157-160; rover_crsf_teleop/include/rover_crsf_teleop/domain/switch_debouncer.hpp:23; rover_crsf_teleop/src/infrastructure/rover_crsf_teleop_node.cpp:706-711
Implementation: Implemented
ParentSysSR: SYS-SR-008
Priority: Must
Status: As-Built
VerificationMethod: Test
VerifiedBy: rover_crsf_teleop/test/unit/test_switch_debouncer.cpp; rover_crsf_teleop/test/unit/test_teleop_use_case.cpp

## 14 [SWR-CRSF-014] Safety: The rover_crsf_teleop shall keep requesting hardware_interface/sw_user_e_stop_set while...
The rover_crsf_teleop shall keep requesting hardware_interface/sw_user_e_stop_set while the e_stop_channel switch is low and the request has not been acknowledged with success (service unavailable, pending or refused), instead of dropping the request.
Rationale: Today an E-Stop set request is dropped with a warning if the service is not ready and is never retried, because requests fire only on a switch change; an operator's E-Stop could therefore be silently lost.
AcceptanceCriteria: With the set service absent when the switch goes low and started afterwards while the switch stays low, the service receives a set request within one control tick (20 ms) of becoming available.
Category: Safety
Comments: Outcome (unavailable/refused) is visible on the 'E-Stop requests' diagnostic as WARN today. Must not retry the reset/latch-reset requests the same way (a reset must stay a deliberate edge per SYS-SR-008).
Evidence: rover_crsf_teleop/src/infrastructure/ros2_trigger_safety_switch.cpp:87-94; rover_crsf_teleop/src/application/teleop_use_case.cpp:178-185
Implementation: Gap
ParentSysSR: SYS-SR-007
Priority: Must
Status: Proposed
VerificationMethod: Test

## 15 [SWR-CRSF-015] Lifecycle: The rover_crsf_teleop shall be a managed lifecycle node that validates parameters and s...
The rover_crsf_teleop shall be a managed lifecycle node that validates parameters and subscribes its inputs in configure, starts the 20 ms control loop in activate, publishes one zero command before its publisher is deactivated in deactivate and in shutdown, and self-transitions to ACTIVE when autostart is true.
Rationale: A supervisor can take RC teleop off the command path without killing the process; leaving the command path always ends with a stop.
AcceptanceCriteria: Launch test: the node reaches ACTIVE and publishes nothing without RC input; integration test: deactivate publishes exactly one zero.
Category: Lifecycle
Comments: Inside the component container Ctrl-C does not run the shutdown transition, so the final stop comes from the twist_mux timeout instead (launch docstring lines 32-36).
Evidence: rover_crsf_teleop/src/infrastructure/rover_crsf_teleop_node.cpp:369-375; rover_crsf_teleop/src/infrastructure/rover_crsf_teleop_node.cpp:794-843; rover_crsf_teleop/src/infrastructure/rover_crsf_teleop_node.cpp:124; rover_crsf_teleop/launch/rover_crsf_teleop.launch.py:130-138
Implementation: Implemented
ParentSysSR: SYS-SR-024
Priority: Must
Status: As-Built
VerificationMethod: Test
VerifiedBy: rover_crsf_teleop/test/e2e/test_teleop_launch.py; rover_crsf_teleop/test/integration/test_teleop_node.cpp

## 16 [SWR-CRSF-016] Build: The rover_crsf_teleop shall, in rover_crsf_teleop.launch.py, load rover_udp_drivers Udp...
The rover_crsf_teleop shall, in rover_crsf_teleop.launch.py, load rover_udp_driver's UdpReceiverNode as rover_crsf_udp_receiver (ip udp_bind_ip 192.168.1.201, port udp_port 10111, source_ip udp_source_ip 192.168.1.1, all read from the teleop config; udp_read remapped to rc/raw_udp; autostart) and the teleop node into one single-threaded component container (rover_crsf_container) with intra-process communication, and shall not start the UDP receiver when use_sim is true.
Rationale: Keeps the ~250 rc/raw_udp datagrams per second off the Zenoh router and preserves the node's single-threaded invariant; there is no receiver in simulation, and the simulation machine does not own 192.168.1.201.
AcceptanceCriteria: Launch-structure tests: both components share one component_container (not _mt), the receiver is started only when use_sim is false, the receiver publishes where the teleop node subscribes, and its ip, port and source_ip come from the teleop config.
Category: Build
Comments: The router side (Serial Utilities Over IP: UDP client to 192.168.1.201:10111, 460800 8N1, raw mode) is configured once in the RutOS WebUI, as documented in rover_crsf_teleop/scripts/rutx11_elrs_udp_forwarding.sh:28-33; the script does not apply it. Unlike the removed serial bridge, nothing needs cycling after an unplug: the receiver keeps its socket and waits for datagrams (README.md:201-203). A receive error on the socket still stops the receiver without re-arming (SWR-TRN-008, Gap).
DerivedRationale: Deployment/performance constraint of the RC input chain; no system-level parent.
Evidence: rover_crsf_teleop/launch/rover_crsf_teleop.launch.py:56-89; rover_crsf_teleop/launch/rover_crsf_teleop.launch.py:92-155; rover_crsf_teleop/config/rover_crsf_teleop.yaml:4-30
Implementation: Implemented
Priority: Should
Status: As-Built
VerificationMethod: Test, Inspection
VerifiedBy: rover_crsf_teleop/test/test_launch_structure.py

## 17 [SWR-CRSF-017] Parameter: The rover_crsf_teleop shall fail the configure transition when a channel role is outsid...
The rover_crsf_teleop shall fail the configure transition when a channel role is outside 1-16, two roles share a channel, channel_switch_threshold is outside the 0-2047 wire range, zero_burst_duration_ms is negative, channel_timeout_ms or link_stats_timeout_ms is not positive, or the link-quality thresholds are inconsistent.
Rationale: A mis-set channel would otherwise drive the E-Stop from a stick or read a stick as full negative deflection.
AcceptanceCriteria: Each listed invalid configuration makes configure return FAILURE (integration and unit tests).
Category: Parameter
DerivedRationale: Configuration robustness of a safety-relevant input; no system-level parent.
Evidence: rover_crsf_teleop/src/application/teleop_config_validation.cpp:59-85; rover_crsf_teleop/src/application/teleop_config_validation.cpp:117-133
Implementation: Implemented
Priority: Must
Status: As-Built
VerificationMethod: Test
VerifiedBy: rover_crsf_teleop/test/unit/test_teleop_config_validation.cpp; rover_crsf_teleop/test/integration/test_teleop_node.cpp

## 18 [SWR-CRSF-018] Safety: The rover_crsf_teleop shall start an RC calibration session only while the node is not ...
The rover_crsf_teleop shall start an RC calibration session only while the node is not ACTIVE, the operator confirms the E-Stop, and a fresh (within e_stop_state_timeout_s = 1.0 s, link healthy) hardware_interface/safety_status shows the physical E-Stop pressed AND the latch active AND the motor contactor open; it shall refuse activation during a session, inhibit teleop for its duration, cancel it after the E-Stop is released for e_stop_grace_s (1.0 s) and after calibration_timeout_s (300 s).
Rationale: The sweep drives the sticks to full throw, so motion must be physically impossible and verified, not assumed.
AcceptanceCriteria: Integration tests: start refused while active, without confirmation, with the E-Stop released, on a software-only E-Stop, when safety_status was never published or is stale/unhealthy; releasing the E-Stop cancels the session; nothing is commanded while it runs.
Category: Safety
Comments: Doc drift: rover_crsf_teleop.yaml:90-102 still says the gate reads hardware_interface/gpio_state and that 'any' stop (incl. software button) counts; the code reads safety_status and requires HW button AND latch AND contactor open (README.md:134-140 is correct).
Evidence: rover_crsf_teleop/src/domain/safety_io_flags.cpp:20-25; rover_crsf_teleop/src/application/calibration_use_case.cpp:102-128; rover_crsf_teleop/src/application/calibration_use_case.cpp:155-158; rover_crsf_teleop/src/infrastructure/rover_crsf_teleop_node.cpp:436-444; rover_crsf_teleop/src/infrastructure/rover_crsf_teleop_node.cpp:794-804; rover_crsf_teleop/config/rover_crsf_teleop.yaml:85; rover_crsf_teleop/config/rover_crsf_teleop.yaml:103-108
Implementation: Implemented
ParentSysSR: SYS-SR-006
Priority: Must
Status: As-Built
VerificationMethod: Test
VerifiedBy: rover_crsf_teleop/test/integration/test_teleop_node.cpp; rover_crsf_teleop/test/unit/test_calibration_use_case.cpp; rover_crsf_teleop/test/unit/test_safety_io_flags.cpp

## 19 [SWR-CRSF-019] Interface: The rover_crsf_teleop shall provide the calibration services rc/calibration/start (rove...
The rover_crsf_teleop shall provide the calibration services rc/calibration/start (rover_msgs/StartRcCalibration), rc/calibration/sweep, finish and cancel (std_srvs/Trigger) and rc/calibration/apply (rover_msgs/SetRcCalibration), publish rc/calibration/state (rover_msgs/RcCalibrationState, reliable, transient-local, depth 1) at calibration_state_rate_hz (5.0 Hz) during a session and on every change, and persist an applied calibration to calibration_file.
Rationale: A client joining mid-session must immediately learn that teleop is held off; persisted endpoints describe the transmitter actually in use.
AcceptanceCriteria: The state topic is received by a late-joining subscriber; an applied calibration changes the mapping without restart and survives a node restart when persisted.
Category: Interface
DerivedRationale: Maintenance function of the RC input; no system-level parent.
Evidence: rover_crsf_teleop/src/infrastructure/rover_crsf_teleop_node.cpp:47-52; rover_crsf_teleop/src/infrastructure/rover_crsf_teleop_node.cpp:544-549; rover_crsf_teleop/src/infrastructure/rover_crsf_teleop_node.cpp:714-748; rover_crsf_teleop/config/rover_crsf_teleop.yaml:80-88
Implementation: Implemented
Priority: Could
Status: As-Built
VerificationMethod: Test
VerifiedBy: rover_crsf_teleop/test/integration/test_teleop_node.cpp; rover_crsf_teleop/test/unit/test_yaml_calibration_store.cpp

## 20 [SWR-CRSF-020] Interface: The rover_crsf_teleop shall, when publish_rc_topics is true, echo decoded frames on rc/...
The rover_crsf_teleop shall, when publish_rc_topics is true, echo decoded frames on rc/channels (rover_msgs/RcChannels) and rc/link (rover_msgs/RcLinkStatus) with QoS best-effort, volatile, depth 1, each capped at rc_topics_rate_hz (25 Hz; 0 = uncapped).
Rationale: Observability for tuning and the Cockpit RC page without pulling ~250 messages/s through the Zenoh router; nothing on the rover consumes them.
AcceptanceCriteria: 'ros2 topic hz rc/channels' reads <= 25 Hz with the receiver at its full packet rate; the publishers are best-effort.
Category: Interface
DerivedRationale: Observability output only; no system-level parent.
Evidence: rover_crsf_teleop/config/rover_crsf_teleop.yaml:32-40; rover_crsf_teleop/src/infrastructure/rover_crsf_teleop_node.cpp:485-491; rover_crsf_teleop/src/infrastructure/rover_crsf_teleop_node.cpp:777-779
Implementation: Implemented
Priority: Could
Status: As-Built
VerificationMethod: Inspection, Test
VerifiedBy: rover_crsf_teleop/test/unit/test_rate_limiter.cpp

## 21 [SWR-CRSF-021] Diagnostics: The rover_crsf_teleop shall publish diagnostics under hardware ID RC Receiver with the ...
The rover_crsf_teleop shall publish diagnostics under hardware ID 'RC Receiver' with the tasks 'RC link', 'E-Stop requests', 'RC channels rate', 'RC UDP link' and 'RC calibration', reporting at most WARN (never ERROR); 'RC channels rate' shall warn when the decoded frame rate deviates by more than rc_channels_rate_tolerance (0.2) from rc_channels_expected_hz (250.0 Hz), and 'RC UDP link' shall warn before the first datagram and when no datagram has arrived for more than 1000 ms.
Rationale: RC teleop is optional, so its faults are warnings; separate tasks distinguish a dead datagram stream (router, cable or UDP receiver) from an out-of-range transmitter or a refused E-Stop request.
AcceptanceCriteria: With no frames the 'RC channels rate' task is WARN; with no datagrams the 'RC UDP link' task is WARN ('No datagrams yet') and turns OK once datagrams arrive and decode; the 'RC link' task follows link loss; a refused or unavailable E-Stop request makes 'E-Stop requests' WARN; no task ever reports ERROR.
Category: Diagnostics
Comments: SYS-SR-022 asks for induced faults to be ERROR; the RC receiver is not in the SYS-SR-022 component list, so WARN-only is a deliberate design choice.
Evidence: rover_crsf_teleop/src/infrastructure/rover_crsf_teleop_node.cpp:95-100; rover_crsf_teleop/src/infrastructure/rover_crsf_teleop_node.cpp:68; rover_crsf_teleop/src/infrastructure/rover_crsf_teleop_node.cpp:1006-1055; rover_crsf_teleop/src/infrastructure/teleop_diagnostics_conversions.cpp:57-59; rover_crsf_teleop/src/infrastructure/teleop_diagnostics_conversions.cpp:101-119; rover_crsf_teleop/config/rover_crsf_teleop.yaml:185-196
Implementation: Implemented
ParentSysSR: SYS-SR-022
Priority: Should
Status: As-Built
VerificationMethod: Test
VerifiedBy: rover_crsf_teleop/test/integration/test_teleop_node.cpp; rover_crsf_teleop/test/unit/test_teleop_diagnostics_conversions.cpp

## 22 [SWR-CRSF-022] Safety: The rover_crsf_teleop shall accept RC input only from the configured router address: ro...
The rover_crsf_teleop shall accept RC input only from the configured router address: rover_crsf_teleop.launch.py shall pass udp_source_ip from the teleop config to the UDP receiver as source_ip, so that datagrams from any other sender are dropped before they are published on rc/raw_udp, and the shipped configuration shall set udp_source_ip to the RUTX11 address (192.168.1.1). A blank udp_source_ip shall keep the router address; only an explicit empty string shall accept any sender, and then the launch file and the teleop node shall each log a warning.
Rationale: CRSF frames carry no authentication and the ELRS input is twist_mux priority 110, above every other velocity source. Without the filter any host that can reach 192.168.1.201:10111 (a host on the wired LAN, a client of the 192.168.77 AP) could command motion or send E-Stop reset and latch-reset switch edges. UdpPacket.address is the bound address, not the sender, so the teleop node cannot filter itself.
AcceptanceCriteria: test_receiver_only_accepts_the_router_by_default: the shipped config yields bind 192.168.1.201, port 10111, source 192.168.1.1; test_receiver_publishes_where_the_teleop_listens: source_ip is taken from the config; e2e test_b_ignores_rc_from_a_foreign_source: deflected-stick CRSF sent from a foreign address for 4 s produces no command on teleop_elrs_cmd_vel_stamped, while test_c_drives_from_rc_over_udp (from the router address) does; test_a_blank_source_ip_keeps_the_router yields 192.168.1.1 for a blank value and test_an_explicit_empty_source_ip_accepts_any yields an empty filter for "".
Category: Safety
Comments: The drop itself is implemented by rover_transport (SWR-TRN-023). Tests: test_launch_structure.py:97-128, test_teleop_launch.py:202-224. An explicit empty udp_source_ip accepts any sender; the config allows that only on a bench (rover_crsf_teleop.yaml:16-21). The filter matches the IP address only: a host that forges 192.168.1.1 as its source is not stopped; only a separate network segment would close that (TBD). Outside rover_ros, the router adds a second layer: a firewall rule dropping datagrams from the 192.168.77 AP to the RC port, applied by rover_crsf_teleop/scripts/rutx11_elrs_udp_forwarding.sh:114-128, and the router's VPN-reject-everything-else rule for WireGuard peers (rutx11_elrs_udp_forwarding.sh:38-45).
Evidence: rover_crsf_teleop/config/rover_crsf_teleop.yaml:16-24; rover_crsf_teleop/launch/rover_crsf_teleop.launch.py:56-89; rover_crsf_teleop/launch/rover_crsf_teleop.launch.py:110-126; rover_crsf_teleop/src/infrastructure/rover_crsf_teleop_node.cpp:502-504; rover_crsf_teleop/src/infrastructure/rover_crsf_teleop_node.cpp:510-516; rover_crsf_teleop/README.md:46-55; rover_twist_mux/config/rover_twist_mux.yaml:21-24
Implementation: Implemented
ParentSysSR: SYS-SR-005, SYS-SR-008
Priority: Must
Status: As-Built
VerificationMethod: Test, Inspection
VerifiedBy: rover_crsf_teleop/test/test_launch_structure.py; rover_crsf_teleop/test/e2e/test_teleop_launch.py