# Requirement set SWRS_DESC (R2026a)
rover_description Software Requirements Specification (ROVER-A1-ROVER_DESCRIPTION-SWRS-V-001). rover_description holds the URDF/xacro model of Rover A1: the kinematic tree and frames (REP-103/105), wheel geometry and joint limits, inertial properties, meshes, sensor mount frames, the simulation sensors and battery, and the <ros2_control> blocks that select and parameterise the hardware plugins (RoverA1System, PhidgetImuSensor) or gz_ros2_control in simulation. All hardware-interface timing and drive-train parameters are URDF <param> tags here. Its launch file generates the URDF and runs robot_state_publisher, which publishes robot_description and the static/joint TF.

## 1 [SWR-DESC-001] Build: The rover_description shall generate the rover_a1 robot description from urdf/rover_a1....
The rover_description shall generate the rover_a1 robot description from urdf/rover_a1.urdf.xacro with the xacro arguments use_sim, namespace, wheel_config_file, battery_config_file, controller_config_file, imu_xyz/imu_rpy, lidar_xyz/lidar_rpy and gps_xyz/gps_rpy.
Rationale: A single parameterised model serves hardware and simulation (SYS-SR-020 ros2_control based software).
AcceptanceCriteria: xacro urdf/rover_a1.urdf.xacro with default arguments and with use_sim:=true controller_config_file:=<file> both produce a URDF that parses; test_wheel_geometry processes the xacro without error.
Category: Build
Evidence: rover_description/urdf/rover_a1.urdf.xacro:1-29; rover_description/urdf/rover_a1/rover_a1_macro.urdf.xacro:4-16; rover_description/README.md:21-23; rover_description/CMakeLists.txt:6-15
Implementation: Implemented
ParentSysSR: SYS-SR-020
Priority: Must
Status: As-Built
VerificationMethod: Test
VerifiedBy: rover_description/test/test_wheel_geometry.py

## 2 [SWR-DESC-002] Interface: The rover_description shall define the frame tree base_footprint -> base_link -> body_l...
The rover_description shall define the frame tree base_footprint -> base_link -> body_link with imu_link, lidar_link, gps_link and the four <prefix>_wheel_base_link / <prefix>_wheel_link frames as children of body_link, using REP-103 axes (+x forward, +y left, +z up) and prefixing every frame with "<namespace>/" when a namespace is set.
Rationale: SYS-SR-021 requires REP-103 conventions and REP-105 frames; base_footprint is the ground projection the odometry filters publish odom -> base_footprint to.
AcceptanceCriteria: ros2 run tf2_tools view_frames shows base_footprint as the root of the robot tree with the listed children; frame names carry the namespace prefix when ROVER_NAMESPACE is set.
Category: Interface
Comments: map and odom (REP-105) are not defined here; they come from the localization / EKF packages.
Evidence: rover_description/urdf/rover_a1/base.urdf.xacro:16-33; rover_description/urdf/rover_a1/base.urdf.xacro:62-85; rover_description/urdf/common/wheel.urdf.xacro:4-6; rover_description/urdf/common/wheel.urdf.xacro:33-45; rover_description/launch/rover_load_urdf.launch.py:191-199; rover_description/README.md:40-69
Implementation: Implemented
ParentSysSR: SYS-SR-021
Priority: Must
Status: As-Built
VerificationMethod: Test, Inspection
VerifiedBy: rover_description/test/test_wheel_geometry.py

## 3 [SWR-DESC-003] Functional: The rover_description shall place base_link above base_footprint by tyre_radius minus t...
The rover_description shall place base_link above base_footprint by tyre_radius minus the wheel axis height above body_link (0.037363 m), with base_link coincident with body_link.
Rationale: Keeps base_footprint on the ground plane (REP-105 2D navigation, SYS-SR-021).
AcceptanceCriteria: footprint_to_base_joint z equals tyre_radius - 0.037363 = 0.132537 m with wheel_01.yaml; base_to_body_joint origin is (0, 0, 0).
Category: Functional
Comments: Axis height from the SolidWorks export (joint_*_* origin z in rover_description/solidworks_exported/ROVER_1000_WATT_VARIANT.SLDASM/urdf/*.csv, re-exported 2026-10-07).
Evidence: rover_description/urdf/rover_a1/rover_a1_macro.urdf.xacro:41-43; rover_description/urdf/rover_a1/rover_a1_macro.urdf.xacro:66-67; rover_description/urdf/rover_a1/base.urdf.xacro:20-33
Implementation: Implemented
ParentSysSR: SYS-SR-021
Priority: Must
Status: As-Built
VerificationMethod: Test
VerifiedBy: rover_description/test/test_wheel_geometry.py

## 4 [SWR-DESC-004] Parameter: The rover_description shall take wheel geometry only from config/wheel_01.yaml (tyre_ra...
The rover_description shall take wheel geometry only from config/wheel_01.yaml (tyre_radius 0.1699 m, wheel_width 0.108 m, wheelbase 0.503 m, wheel_separation 0.617 m, tyre_y_offset -0.00171 m) and mount the fl, fr, rl and rr wheels at (+/-wheelbase/2, +/-wheel_separation/2) in their REP-103 quadrants at a common height, with each tyre collision cylinder |tyre_y_offset| inboard of its joint.
Rationale: Single source of truth for kinematic geometry used by the URDF and (via its test) by the drive controller (SYS-SR-003).
AcceptanceCriteria: For each prefix the body_to_<prefix>_wheel_base_joint origin equals (sx*0.2515, sy*0.3085, 0.037363) with the quadrant signs fl(+,+), fr(+,-), rl(-,+), rr(-,-), and the <prefix>_wheel_link collision origin y equals -sy*0.00171 (contact patches 0.6136 m apart).
Category: Parameter
Comments: Values from the SolidWorks export of 2026-10-07: wheel joints at x +0.2515 / -0.25156, y +/-0.30851, z 0.037363; tread band of link_*.STL centred 1.71 mm inboard of the joint.
Evidence: rover_description/config/wheel_01.yaml:1-22; rover_description/urdf/rover_a1/rover_a1_macro.urdf.xacro:37-43; rover_description/urdf/rover_a1/rover_a1_macro.urdf.xacro:79-108; rover_description/urdf/common/wheel.urdf.xacro:7-41; rover_description/urdf/common/wheel.urdf.xacro:67-72
Implementation: Implemented
ParentSysSR: SYS-SR-003, SYS-SR-021
Priority: Must
Status: As-Built
VerificationMethod: Test
VerifiedBy: rover_description/test/test_wheel_geometry.py; rover_controller/test/test_wheel_geometry.py

## 5 [SWR-DESC-005] Parameter: The rover_description shall model each wheel joint as a continuous joint about +y with ...
The rover_description shall model each wheel joint as a continuous joint about +y with limit effort 64.5 and velocity 10.958 rad/s, so that a positive joint velocity drives the rover forward.
Rationale: Uniform joint sign for all four wheels (no negated axis) and a velocity limit that the drive controller limits are checked against (SYS-SR-002, SYS-SR-004).
AcceptanceCriteria: All four <prefix>_wheel_base_to_<prefix>_wheel_joint elements have type continuous, axis (0 1 0) and limit velocity 10.958; rover_controller test_drive_limits_respect_joint_velocity_limit reads that limit.
Category: Parameter
Comments: The origin of 10.958 rad/s and 64.5 (N·m) is not documented in the package; 2800 rpm / 23.3 = 12.58 rad/s is the full-duty speed used by the PIDs. TBC against the motor datasheet.
Evidence: rover_description/urdf/common/wheel.urdf.xacro:41-49; rover_description/README.md:61-65
Implementation: Implemented
ParentSysSR: SYS-SR-002, SYS-SR-004
Priority: Must
Status: As-Built
VerificationMethod: Test, Inspection
VerifiedBy: rover_controller/test/test_wheel_geometry.py

## 6 [SWR-DESC-006] Interface: The rover_description shall declare, with use_sim false, a <ros2_control> system compon...
The rover_description shall declare, with use_sim false, a <ros2_control> system component named "rover_system_node" (no namespace prefix: its node is rover_system_node in the controller manager's namespace, e.g. /rover/rover_system_node) using plugin rover_hardware_interface/RoverA1System with the four wheel joints each exposing a velocity command interface and position, velocity and effort state interfaces, and with use_sim true the plugin gz_ros2_control/GazeboSimSystem with the same joints plus the IMU state interfaces.
Rationale: SYS-SR-002 (4 joints, velocity mode, encoder feedback) and SYS-SR-020 (ros2_control hardware interface).
AcceptanceCriteria: The generated URDF contains exactly one system component with 4 joints x (1 command + 3 state interfaces) and the plugin matching use_sim; RoverA1System on_init() accepts it.
Category: Interface
Evidence: rover_description/urdf/rover_a1/rover_a1_macro.urdf.xacro:103-145; rover_description/README.md:25-38
Implementation: Implemented
ParentSysSR: SYS-SR-002, SYS-SR-020
Priority: Must
Status: As-Built
VerificationMethod: Test, Inspection
VerifiedBy: rover_hardware_interface/test/rover_system/test_rover_a1_system_on_init.cpp

## 7 [SWR-DESC-007] Parameter: The rover_description shall set the RoverA1System safety-link parameters modbus_host 19...
The rover_description shall set the RoverA1System safety-link parameters modbus_host 192.168.88.11, modbus_port 502, modbus_connection_retry_count 0, modbus_connection_retry_delay_ms 1000, modbus_response_timeout_ms 150, safety_wdg_kick_period_ms 200, safety_io_poll_period_ms 100 and safety_latch_reset_pulse_ms 100.
Rationale: These values bound the E-Stop heartbeat and state latency (SYS-SR-006, SYS-SR-023); the response timeout must stay under the kick period so one stalled transaction cannot eat a heartbeat tick.
AcceptanceCriteria: The generated URDF (use_sim false) contains exactly these values; modbus_response_timeout_ms < safety_wdg_kick_period_ms.
Category: Parameter
Comments: No automated test asserts these URDF values; the retry count 0 blocks on_configure() until the PLC is reachable. Relay watchdog window ~1 s is a measured hardware property (SAFETY_CHAIN.md:144).
Evidence: rover_description/urdf/rover_a1/rover_a1_macro.urdf.xacro:147-187; rover_arch/SAFETY_CHAIN.md:136-148
Implementation: Implemented
ParentSysSR: SYS-SR-006, SYS-SR-023
Priority: Must
Status: As-Built
VerificationMethod: Inspection, Test

## 8 [SWR-DESC-008] Parameter: The rover_description shall set the RoverA1System drive-train parameters driver_states_...
The rover_description shall set the RoverA1System drive-train parameters driver_states_update_frequency 20.0, max_rover_driver_initialization_attempts 3, max_rover_driver_activation_attempts 3, the three error-filter counts 2, driver_comm_timeout_ms 300, motor_failsafe_timeout_ms 500, motor_acceleration 4.0, motor_current_limit 15.0, motor_supply_voltage 24.0, motor_torque_constant 0.11, max_rpm_motor_speed 2800, gear_ratio 23.3, gearbox_efficiency 0.70, raw_current_to_amps_scale 0.001 and encoder_resolution 1024.
Rationale: Drive actuation and feedback scaling (SYS-SR-002) and the DCC1000 command-loss failsafe (SYS-SR-011).
AcceptanceCriteria: The generated URDF contains exactly these values and RoverA1System on_init() accepts them.
Category: Parameter
Comments: Comment drift in the URDF: motor_current_limit comment (lines 228-232) describes 10 A, value is 15.0; motor_acceleration comment (222-225) describes 2.0 duty/s, value is 4.0.
Evidence: rover_description/urdf/rover_a1/rover_a1_macro.urdf.xacro:189-254
Implementation: Implemented
ParentSysSR: SYS-SR-002, SYS-SR-011
Priority: Must
Status: As-Built
VerificationMethod: Inspection, Test
VerifiedBy: rover_hardware_interface/test/rover_system/test_rover_a1_system_on_init.cpp

## 9 [SWR-DESC-009] Parameter: The rover_description shall set the E-Stop reset tolerances velocity_command_zero_toler...
The rover_description shall set the E-Stop reset tolerances velocity_command_zero_tolerance 0.4 rad/s and velocity_state_zero_tolerance 0.05 rad/s.
Rationale: SYS-SR-008: the SW E-Stop cannot be reset while commanded to move or still rolling; 0.4 rad/s is the smallest value above the wheel PID i_clamp_max (0.33 rad/s).
AcceptanceCriteria: The generated URDF contains 0.4 and 0.05; 0.4 > max i_clamp_max in rover_controller/config/wheel_01_controller.yaml.
Category: Parameter
Comments: Doc drift: rover_arch/SAFETY_CHAIN.md:228 states 0.35 rad/s. No test ties the tolerance to i_clamp_max.
Evidence: rover_description/urdf/rover_a1/rover_a1_macro.urdf.xacro:256-284; rover_controller/config/wheel_01_controller.yaml:90
Implementation: Implemented
ParentSysSR: SYS-SR-008
Priority: Must
Status: As-Built
VerificationMethod: Inspection

## 10 [SWR-DESC-010] Parameter: The rover_description shall declare, with use_sim false, a <ros2_control> sensor compon...
The rover_description shall declare, with use_sim false, a <ros2_control> sensor component "rover_imu" (no namespace prefix: its node is rover_imu in the controller manager's namespace, e.g. /rover/rover_imu) using plugin rover_hardware_interface/PhidgetImuSensor with data_interval_ms 8, callback_delta_epsilon_ms 1, Madgwick gain 0.00304 and zeta 0.00151, use_mag false, stateless false, remove_gravity_vector false and world_frame enu, exporting the 10 orientation / angular_velocity / linear_acceleration state interfaces.
Rationale: SYS-SR-019 IMU at >= 100 Hz (8 ms = 125 Hz sampling). The magnetometer is disabled because it is uncalibrated near the motors.
AcceptanceCriteria: The generated URDF contains the rover_imu component with these values; PhidgetImuSensor on_init() accepts it.
Category: Parameter
Evidence: rover_description/urdf/common/imu.urdf.xacro:4-23; rover_description/urdf/common/imu.urdf.xacro:95-127
Implementation: Implemented
ParentSysSR: SYS-SR-019
Priority: Should
Status: As-Built
VerificationMethod: Inspection, Test
VerifiedBy: rover_hardware_interface/test/rover_sensors/test_phidget_imu_sensor_on_init.cpp

## 11 [SWR-DESC-011] Functional: The rover_description shall, in rover_load_urdf.launch.py, take the IMU, lidar and GPS ...
The rover_description shall, in rover_load_urdf.launch.py, take the IMU, lidar and GPS mount poses from the ROVER_{IMU,LIDAR,GPS}_LOCALIZATION_{X,Y,Z} and _ORIENTATION_{R,P,Y} environment variables, falling back to the defaults (IMU xyz (-0.09, 0.0, 0.2), rpy (3.14159, 0.0, 0.0); lidar and GPS all 0.0) for unset or non-finite values.
Rationale: Sensor extrinsics are per-rover (balena device variables); a malformed value must not break xacro and take robot_state_publisher down (SYS-SR-021 frames).
AcceptanceCriteria: With ROVER_IMU_LOCALIZATION_X=abc the launch prints a warning and body_to_imu_joint x is -0.09; with a finite value the joint origin uses it.
Category: Functional
Comments: Not covered by a test. With use_sim true the macro replaces the IMU pose with (-0.09, 0.0, 0.2) / (0, 0, 0) and lifts an all-zero lidar pose to z 0.45 (rover_a1_macro.urdf.xacro:18-29). The IMU default roll of 3.14159 rad (upside-down mount) is a launch default, not a measured value (TBC).
Evidence: rover_description/launch/rover_load_urdf.launch.py:38-54; rover_description/launch/rover_load_urdf.launch.py:122-143; rover_description/launch/rover_load_urdf.launch.py:145-174
Implementation: Implemented
ParentSysSR: SYS-SR-021
Priority: Should
Status: As-Built
VerificationMethod: Test

## 12 [SWR-DESC-012] Parameter: The rover_description shall declare body_link inertial mass 39.5026 kg and each wheel l...
The rover_description shall declare body_link inertial mass 39.5026 kg and each wheel link mass 4.79294 kg (58.6744 kg in total).
Rationale: Inertial properties drive the simulation dynamics; SYS-SR-001 caps the platform mass at 60 kg including batteries and excluding payload.
AcceptanceCriteria: Sum of all <mass> values in the generated URDF equals 58.6744 kg; a physical weighing of the assembled platform is <= 60.0 kg (SYS-SR-001).
Category: Parameter
Comments: Mass fidelity: 58.67 kg is the SolidWorks assembly mass (ROVER_1000_WATT_VARIANT, 2026-10-08 after the clash fixes, batteries included), not a measured value; it does not by itself verify SYS-SR-001. Body and wheel inertials are computed from the per-part SolidWorks mass properties, which honour the mass overrides that the URDF exporter ignores: DCC1000 78.8 g each (ASSUMPTION, not weighed), RUTX11 456 g (distributor spec), LiFePO4 battery 5 kg (owner value). The exporter's body inertia (izz 0.57 kg m^2) does not add up to the assembly yaw inertia (6.18 kg m^2) and is not used. Sensors have no inertial links.
Evidence: rover_description/urdf/rover_a1/base.urdf.xacro:68-81; rover_description/config/wheel_01.yaml:10-14; rover_description/urdf/common/wheel.urdf.xacro:74-84
Implementation: Deviation
ParentSysSR: SYS-SR-001
Priority: Should
Status: As-Built
VerificationMethod: Inspection, Analysis

## 13 [SWR-DESC-013] Interface: The rover_description shall start robot_state_publisher as node rover_state_publisher_n...
The rover_description shall start robot_state_publisher as node rover_state_publisher_node in the requested namespace with the generated robot_description, frame_prefix "<namespace>/" and use_sim_time equal to use_sim, when publish_robot_state is true (default).
Rationale: Publishes robot_description and the robot TF tree (SYS-SR-021).
AcceptanceCriteria: ros2 node list shows <ns>/rover_state_publisher_node; ros2 param get shows frame_prefix "<ns>/"; with publish_robot_state false no node starts.
Category: Interface
Comments: No test runs this launch file; rover_controller/test/test_controller_launch.py only checks the arguments passed to its include.
Evidence: rover_description/launch/rover_load_urdf.launch.py:176-211; rover_description/README.md:89-102
Implementation: Implemented
ParentSysSR: SYS-SR-021
Priority: Must
Status: As-Built
VerificationMethod: Test, Inspection

## 14 [SWR-DESC-014] Functional: The rover_description shall, with use_sim true, provide Gazebo sensors on the IMU, lida...
The rover_description shall, with use_sim true, provide Gazebo sensors on the IMU, lidar and GPS frames: IMU at 50 Hz on <ns>imu/data_raw with gaussian noise, a 16-ring gpu_lidar over +/-15 deg with 720 samples, 0.2-20 m range at 10 Hz on <ns>lidar, and a navsat sensor at 5 Hz on <ns>gps/fix.
Rationale: Simulation stand-ins for the RS16 lidar, RUTX11 GNSS and Phidgets IMU used by the navigation stack in Gazebo.
AcceptanceCriteria: The use_sim:=true URDF contains the three <sensor> elements with these rates and topics.
Category: Functional
DerivedRationale: Simulation fidelity requirement; the SYS-SRs specify the physical platform only.
Evidence: rover_description/urdf/common/imu.urdf.xacro:52-93; rover_description/urdf/common/lidar.urdf.xacro:12-53; rover_description/urdf/common/gps.urdf.xacro:12-58; rover_description/urdf/rover_a1/rover_a1_macro.urdf.xacro:18-29
Implementation: Implemented
Priority: Could
Status: As-Built
VerificationMethod: Inspection

## 15 [SWR-DESC-015] Performance: The rover_description shall configure the simulated IMU update_rate at 100 Hz or faster.
The rover_description shall configure the simulated IMU update_rate at 100 Hz or faster.
Rationale: SYS-SR-019 requires IMU data at >= 100 Hz; the simulation should exercise the same rate as the hardware target.
AcceptanceCriteria: The use_sim:=true URDF IMU sensor <update_rate> is >= 100.
Category: Performance
Comments: Simulated IMU is 50 Hz today, matching the 50 Hz imu broadcaster (rover_controller).
Evidence: rover_description/urdf/common/imu.urdf.xacro:57
Implementation: Gap
ParentSysSR: SYS-SR-019
Priority: Could
Status: Proposed
VerificationMethod: Inspection

## 16 [SWR-DESC-016] Parameter: The rover_description shall configure the simulated battery (Gazebo LinearBatteryPlugin...
The rover_description shall configure the simulated battery (Gazebo LinearBatteryPlugin) with capacity 40.0 Ah, initial charge 0.7 of capacity, charging_time 8.0 h, power_load 160.0 W and discharging disabled by default.
Rationale: Simulation of the BAT01 pack for SYS-SR-015 runtime estimates (~6 h at 160 W per the config comment).
AcceptanceCriteria: The use_sim:=true URDF LinearBatteryPlugin shows capacity 40.0, initial_charge 28.0 and start_draining false.
Category: Parameter
Comments: SYS-SR-015 duration and duty cycle are [TBD]. power_load is divided by 100 as a workaround for gz-sim issue 225 (battery.urdf.xacro:23-24). Simulation only; not evidence for SYS-SR-015 on hardware.
Evidence: rover_description/config/battery.yaml:1-17; rover_description/urdf/common/battery.urdf.xacro:4-28; rover_description/urdf/rover_a1/rover_a1_macro.urdf.xacro:45-48; rover_description/urdf/rover_a1/rover_a1_macro.urdf.xacro:297-302
Implementation: Implemented
ParentSysSR: SYS-SR-015
Priority: Could
Status: As-Built
VerificationMethod: Inspection