# Requirement set SWRS_MUX (R2026a)
rover_twist_mux Software Requirements Specification (ROVER-A1-ROVER_TWIST_MUX-SWRS-V-001). rover_twist_mux arbitrates the rover's velocity command sources. It configures and launches the upstream twist_mux node (the sole publisher of cmd_vel) with four prioritised, time-limited TwistStamped inputs (ELRS RC, Foxglove joystick, Driver UI, Nav 2) and one safety lock, and it provides two adapters: rover_motion_lock_node, which maps the safety PLC state (hardware_interface/safety_status + safety_command_echo) onto the fail-safe-closed motion_lock (std_msgs/Bool) that masks every input, and rover_command_freshness_node, which drops Driver UI commands delivered late by a stalled websocket. It is gate 2 of the five motion gates in rover_arch/SAFETY_CHAIN.md; the contactor and the hardware interface's write() gate are independent of it.

## 1 [SWR-MUX-001] Interface: The rover_twist_mux shall publish the arbitrated velocity command as geometry_msgs/Twis...
The rover_twist_mux shall publish the arbitrated velocity command as geometry_msgs/TwistStamped on cmd_vel (twist_mux cmd_vel_out remapped) and shall be the only publisher of cmd_vel in the platform launch.
Rationale: A single arbiter prevents sources racing each other on cmd_vel; the drive controller consumes only this topic.
AcceptanceCriteria: With the platform running, 'ros2 topic info -v cmd_vel' lists exactly one publisher (rover_twist_mux_node) of type geometry_msgs/msg/TwistStamped.
Category: Interface
Comments: Sole-publisher property is documented (README) but not checked by any automated test.
Evidence: rover_twist_mux/config/rover_twist_mux.yaml:3; rover_twist_mux/launch/rover_twist_mux.launch.py:110-119; rover_twist_mux/README.md:13-14
Implementation: Implemented
ParentSysSR: SYS-SR-005
Priority: Must
Status: As-Built
VerificationMethod: Inspection, Demonstration

## 2 [SWR-MUX-002] Functional: The rover_twist_mux shall accept velocity commands from four inputs with strictly order...
The rover_twist_mux shall accept velocity commands from four inputs with strictly ordered priorities - cmd_elrs (teleop_elrs_cmd_vel_stamped, 110) > joystick (teleop_foxglove_cmd_vel_stamped, 100) > driver_interface (teleop_driver_interface_cmd_vel_fresh_stamped, 8) > nav (nav_cmd_vel_stamped, 5) - and shall forward only the highest-priority input that has not timed out.
Rationale: The line-of-sight RC operator has the last word; every teleop source pre-empts autonomy deterministically.
AcceptanceCriteria: The shipped config lists the four inputs with priorities 110/100/8/5, no two equal and all within [1, 255]; with several inputs publishing simultaneously only the highest-priority input appears on cmd_vel.
Category: Functional
Comments: SYS-SR-005 lists its 4 sources as [TBD] (joystick, remote/web UI, navigation, autonomy/docking); the as-built set is ELRS RC, Foxglove, Driver UI, Nav 2 - there is no separate docking/autonomy input. Arbitration itself is upstream twist_mux; the test pins the configured order only.
Evidence: rover_twist_mux/config/rover_twist_mux.yaml:4-24; rover_twist_mux/test/unit/test_twist_mux_priorities.py:34-93
Implementation: Implemented
ParentSysSR: SYS-SR-005
Priority: Must
Status: As-Built
VerificationMethod: Test, Inspection
VerifiedBy: rover_twist_mux/test/unit/test_twist_mux_priorities.py

## 3 [SWR-MUX-003] Safety: The rover_twist_mux shall stop forwarding an input when no message has been received on...
The rover_twist_mux shall stop forwarding an input when no message has been received on it within its timeout: 0.5 s for cmd_elrs, joystick and nav, and 0.3 s for driver_interface.
Rationale: A silent or dead source must not keep the rover moving on its last command; the Driver UI timeout is three periods of its 10 Hz stream.
AcceptanceCriteria: After the active source stops publishing, cmd_vel carries no further commands from that source after at most its configured timeout (0.5 s or 0.3 s) and the next unexpired input, if any, is forwarded.
Category: Safety
Comments: All timeouts are <= the 500 ms of SYS-SR-011. The actual zeroing of the wheels after the mux stops forwarding is done downstream by diff_drive's cmd_vel_timeout (0.5 s, rover_controller), so the end-to-end stop is a combination of both packages. No automated test exercises the upstream twist_mux timeouts.
Evidence: rover_twist_mux/config/rover_twist_mux.yaml:8; rover_twist_mux/config/rover_twist_mux.yaml:14; rover_twist_mux/config/rover_twist_mux.yaml:18; rover_twist_mux/config/rover_twist_mux.yaml:23; rover_crsf_teleop/launch/rover_crsf_teleop.launch.py:30-33; rover_controller/config/wheel_01_controller.yaml:192
Implementation: Implemented
ParentSysSR: SYS-SR-011, SYS-SR-012
Priority: Must
Status: As-Built
VerificationMethod: Test

## 4 [SWR-MUX-004] Safety: The rover_twist_mux shall mask every velocity input while motion_lock is true or has no...
The rover_twist_mux shall mask every velocity input while motion_lock is true or has not been received within 0.5 s, by configuring the motion_lock lock at priority 200, above every input priority.
Rationale: An active E-Stop condition must stop all sources, and a dead lock publisher must close the mux rather than open it.
AcceptanceCriteria: The lock priority (200) is strictly greater than every input priority; with motion_lock=true (or no motion_lock for > 0.5 s) no command from any input appears on cmd_vel.
Category: Safety
Comments: Known gap (rover_arch/SAFETY_CHAIN.md:231-233): no end-to-end test shows that an asserted motion_lock actually stops cmd_vel at the third-party mux; needs a launch_testing fixture. Defence in depth only: the contactor and RoverA1System::write() gate motion independently.
Evidence: rover_twist_mux/config/rover_twist_mux.yaml:26-33; rover_twist_mux/test/unit/test_twist_mux_priorities.py:96-99; rover_arch/SAFETY_CHAIN.md:195-198
Implementation: Implemented
ParentSysSR: SYS-SR-006, SYS-SR-007, SYS-SR-008
Priority: Must
Status: As-Built
VerificationMethod: Test, Inspection
VerifiedBy: rover_twist_mux/test/unit/test_twist_mux_priorities.py

## 5 [SWR-MUX-005] Interface: The rover_twist_mux shall publish the motion lock state as std_msgs/Bool on motion_lock...
The rover_twist_mux shall publish the motion lock state as std_msgs/Bool on motion_lock with QoS KeepLast(1), reliable, at publish_frequency (10.0 Hz).
Rationale: twist_mux treats a lock topic older than its 0.5 s timeout as locked, so the publisher must stay well inside that window.
AcceptanceCriteria: 'ros2 topic hz motion_lock' reports 10 Hz (one message per 100 ms timer period); the publisher QoS is reliable, depth 1; data is true whenever any lock condition of SWR-MUX-007..010 holds.
Category: Interface
Comments: A rate tolerance is TBD; the integration test checks the lock value, not the rate.
Evidence: rover_twist_mux/src/infrastructure/motion_lock_node.cpp:117-123; rover_twist_mux/src/infrastructure/motion_lock_node.cpp:172-179; rover_twist_mux/config/rover_motion_lock.yaml:3
Implementation: Implemented
ParentSysSR: SYS-SR-007, SYS-SR-023
Priority: Must
Status: As-Built
VerificationMethod: Test
VerifiedBy: rover_twist_mux/test/integration/test_motion_lock_node.cpp

## 6 [SWR-MUX-006] Interface: The rover_twist_mux shall subscribe hardware_interface/safety_status (rover_msgs/Safety...
The rover_twist_mux shall subscribe hardware_interface/safety_status (rover_msgs/SafetyStatus) and hardware_interface/safety_command_echo (rover_msgs/SafetyCommandEcho) with QoS KeepLast(1), reliable, volatile, and shall use SafetyCommandEcho fields only as reasons to inhibit motion.
Rationale: Matches the hardware interface publishers; a latched (transient-local) sample would hide a dead publisher. Echoes of commanded coils are never evidence of plant state.
AcceptanceCriteria: Code review shows both subscriptions with reliable/volatile/depth 1; no code path unlocks motion based on a SafetyCommandEcho field.
Category: Interface
Evidence: rover_twist_mux/src/infrastructure/motion_lock_node.cpp:100-113; rover_twist_mux/src/infrastructure/motion_lock_node.cpp:40-54; rover_arch/SAFETY_CHAIN.md:166-171
Implementation: Implemented
ParentSysSR: SYS-SR-023
Priority: Must
Status: As-Built
VerificationMethod: Inspection, Test
VerifiedBy: rover_twist_mux/test/integration/test_motion_lock_node.cpp

## 7 [SWR-MUX-007] Safety: The rover_twist_mux shall assert motion_lock (true) from start-up until both a SafetySt...
The rover_twist_mux shall assert motion_lock (true) from start-up until both a SafetyStatus and a SafetyCommandEcho message have been received.
Rationale: Fail-safe closed: with no safety IO there is no driving; acting on one half alone would read the missing half's stop conditions as inactive.
AcceptanceCriteria: With no safety topics, or only SafetyStatus, published: motion_lock is true on every sample for the whole test duration.
Category: Safety
Comments: Consequence: with no rover_hardware_interface running the rover accepts no velocity commands (README.md:74-76). Simulation does not launch this package.
Evidence: rover_twist_mux/src/domain/motion_lock_health.cpp:34-38; rover_twist_mux/src/infrastructure/motion_lock_node.cpp:151-157; rover_twist_mux/include/rover_twist_mux/domain/motion_lock_health.hpp:45-46; rover_twist_mux/include/rover_twist_mux/domain/safety_io_flags.hpp:47-63
Implementation: Implemented
ParentSysSR: SYS-SR-006, SYS-SR-007
Priority: Must
Status: As-Built
VerificationMethod: Test
VerifiedBy: rover_twist_mux/test/integration/test_motion_lock_node.cpp; rover_twist_mux/test/unit/test_motion_lock_health.cpp; rover_twist_mux/test/unit/test_motion_lock_policy.cpp

## 8 [SWR-MUX-008] Safety: The rover_twist_mux shall assert motion_lock when the older of the two safety messages ...
The rover_twist_mux shall assert motion_lock when the older of the two safety messages is older than gpio_timeout (1.0 s).
Rationale: A hardware interface that stops publishing must not leave the mux open on last-known values; neither topic may hide behind the other.
AcceptanceCriteria: After either safety topic stops while the other continues, motion_lock becomes true no later than 1.0 s plus one publish period (0.1 s) after the last message of the stopped topic.
Category: Safety
Comments: An age exactly equal to the timeout is still fresh (test OlderAgeExactlyAtTheTimeoutIsStillFresh).
Evidence: rover_twist_mux/src/domain/motion_lock_health.cpp:40-51; rover_twist_mux/config/rover_motion_lock.yaml:4
Implementation: Implemented
ParentSysSR: SYS-SR-007, SYS-SR-023
Priority: Must
Status: As-Built
VerificationMethod: Test
VerifiedBy: rover_twist_mux/test/integration/test_motion_lock_node.cpp; rover_twist_mux/test/unit/test_motion_lock_health.cpp

## 9 [SWR-MUX-009] Safety: The rover_twist_mux shall assert motion_lock while SafetyStatus.link_healthy is false, ...
The rover_twist_mux shall assert motion_lock while SafetyStatus.link_healthy is false, even when no stop condition is active.
Rationale: With the PLC link down the messages keep arriving with last-known-good values, so staleness alone cannot detect it.
AcceptanceCriteria: Publishing fresh all-clear safety messages with link_healthy=false yields motion_lock=true and an ERROR-level 'Motion lock' diagnostic.
Category: Safety
Evidence: rover_twist_mux/src/domain/motion_lock_health.cpp:55-62; rover_twist_mux/src/infrastructure/motion_lock_node.cpp:166
Implementation: Implemented
ParentSysSR: SYS-SR-006, SYS-SR-007
Priority: Must
Status: As-Built
VerificationMethod: Test
VerifiedBy: rover_twist_mux/test/integration/test_motion_lock_node.cpp; rover_twist_mux/test/unit/test_motion_lock_health.cpp

## 10 [SWR-MUX-010] Safety: The rover_twist_mux shall assert motion_lock while any enabled stop condition is active...
The rover_twist_mux shall assert motion_lock while any enabled stop condition is active - hardware E-Stop button pressed, software E-Stop user button triggered, motor-driver fault stop, or safety latch held - with all four conditions enabled in the shipped configuration.
Rationale: Any single active stop is sufficient to inhibit; the latch condition keeps motion inhibited after the trip source clears until an explicit reset.
AcceptanceCriteria: For each of the four flags set alone (others clear, fresh, link healthy), motion_lock is true and the diagnostic message names that reason; with all clear, motion_lock is false.
Category: Safety
Comments: The CPU watchdog heartbeat is deliberately not a lock condition (a stalled heartbeat trips the relay, which sets the latch).
Evidence: rover_twist_mux/src/domain/motion_lock_policy.cpp:39-54; rover_twist_mux/config/rover_motion_lock.yaml:6-10; rover_twist_mux/src/domain/motion_lock_health.cpp:71-77
Implementation: Implemented
ParentSysSR: SYS-SR-006, SYS-SR-007, SYS-SR-008
Priority: Must
Status: As-Built
VerificationMethod: Test
VerifiedBy: rover_twist_mux/test/unit/test_motion_lock_policy.cpp; rover_twist_mux/test/unit/test_motion_lock_health.cpp; rover_twist_mux/test/integration/test_motion_lock_node.cpp

## 11 [SWR-MUX-011] Parameter: The rover_twist_mux shall treat an open motor contactor as a lock condition only when r...
The rover_twist_mux shall treat an open motor contactor as a lock condition only when require_motor_contactor_engaged is true, which shall be false in the shipped configuration.
Rationale: The contactor feedback has inverted sense and is unverified on hardware, so it is opt-in.
AcceptanceCriteria: With require_motor_contactor_engaged=false an open contactor alone does not lock; with it true an open contactor locks and a closed one does not.
Category: Parameter
Comments: Marked 'unverified on hardware' in the config; enabling requires a hardware check first.
DerivedRationale: Technical option of the motion-lock policy; no system requirement asks for contactor-based gating in software (the contactor itself is SYS-SR-006 hardware).
Evidence: rover_twist_mux/src/domain/motion_lock_policy.cpp:56-60; rover_twist_mux/config/rover_motion_lock.yaml:12-14; rover_twist_mux/src/motion_lock_params.yaml:33-38
Implementation: Implemented
Priority: Could
Status: As-Built
VerificationMethod: Test, Inspection
VerifiedBy: rover_twist_mux/test/unit/test_motion_lock_policy.cpp

## 12 [SWR-MUX-012] Parameter: The rover_twist_mux shall reject a motion-lock publish_frequency outside [1.0, 100.0] H...
The rover_twist_mux shall reject a motion-lock publish_frequency outside [1.0, 100.0] Hz and a gpio_timeout outside [0.1, 10.0] s.
Rationale: Bounds keep the lock republished inside the mux lock timeout and keep the staleness window meaningful.
AcceptanceCriteria: Starting rover_motion_lock_node with publish_frequency=0.5 or gpio_timeout=20.0 fails parameter validation.
Category: Parameter
Comments: The accepted lower bound 1.0 Hz is below 1 / 0.5 s (the mux lock timeout, rover_twist_mux.yaml:32) = 2 Hz, so a valid-but-low setting would make the mux flap to locked (fail-safe, but not usable). Consider raising the lower bound above 2 Hz.
DerivedRationale: Parameter validation (generate_parameter_library) supporting SWR-MUX-005 and SWR-MUX-008.
Evidence: rover_twist_mux/src/motion_lock_params.yaml:2-16
Implementation: Implemented
Priority: Should
Status: As-Built
VerificationMethod: Inspection

## 13 [SWR-MUX-013] Diagnostics: The rover_twist_mux shall report a Motion lock diagnostic (hardware ID Motion Lock) tha...
The rover_twist_mux shall report a 'Motion lock' diagnostic (hardware ID 'Motion Lock') that is STALE before the first evaluation, ERROR when the safety input is missing, stale or the PLC link is unhealthy, WARN when a stop condition holds the lock, and OK when motion is permitted, including the per-flag values, topic ages and policy settings.
Rationale: Operators need to see why the rover will not move; the diagnostic is derived from the same evaluation as the lock so they cannot disagree.
AcceptanceCriteria: On /diagnostics the 'Motion lock' status level matches the four cases above for injected inputs; induced input failures are reported as ERROR.
Category: Diagnostics
Comments: Publication rate is the diagnostic_updater default period (not overridden in this package).
Evidence: rover_twist_mux/src/infrastructure/motion_lock_node.cpp:125-126; rover_twist_mux/src/infrastructure/motion_lock_node.cpp:194-227; rover_twist_mux/src/infrastructure/motion_lock_node.cpp:69-79
Implementation: Implemented
ParentSysSR: SYS-SR-022
Priority: Should
Status: As-Built
VerificationMethod: Test
VerifiedBy: rover_twist_mux/test/unit/test_motion_lock_health.cpp

## 14 [SWR-MUX-014] Functional: The rover_twist_mux shall relay a Driver UI command from teleop_driver_interface_cmd_ve...
The rover_twist_mux shall relay a Driver UI command from teleop_driver_interface_cmd_vel_stamped to teleop_driver_interface_cmd_vel_fresh_stamped unchanged only if its receive-time-minus-stamp latency exceeds the latency baseline by at most max_delay (0.3 s), and shall drop commands with a zero or negative header stamp.
Rationale: twist_mux judges freshness by arrival time; a websocket that stalls on Wi-Fi delivers old commands in a burst, which would replay seconds-old motion.
AcceptanceCriteria: A command whose latency exceeds the baseline by more than 0.3 s is not republished; an unstamped command is not republished; commands within 0.3 s of the baseline are republished byte-identical.
Category: Functional
Comments: Receive time is the wall clock (works under sim time). Limitation (README.md:101-102): a delay that stays steady for 2 s after a silence is indistinguishable from a clock step and is accepted.
Evidence: rover_twist_mux/src/domain/command_freshness_filter.cpp:44-63; rover_twist_mux/src/infrastructure/command_freshness_node.cpp:102-122; rover_twist_mux/config/rover_command_freshness.yaml:4-9
Implementation: Implemented
ParentSysSR: SYS-SR-011, SYS-SR-012
Priority: Must
Status: As-Built
VerificationMethod: Test
VerifiedBy: rover_twist_mux/test/unit/test_command_freshness_filter.cpp; rover_twist_mux/test/integration/test_command_freshness_node.cpp

## 15 [SWR-MUX-015] Functional: The rover_twist_mux shall, in rover_command_freshness_node, let the filters latency bas...
The rover_twist_mux shall, in rover_command_freshness_node, let the filter's latency baseline rise by at most max_clock_drift (0.001 s per s of traffic, crediting at most 1.0 s per command gap), and shall re-baseline only on a run of rejected commands that starts after at least resync_gap (1.0 s) of silence and stays within max_delay of itself for resync_time (2.0 s).
Rationale: Follows clock drift between browser and rover and recovers from a backwards clock step, while a growing mid-stream backlog or a stale burst can never re-baseline itself.
AcceptanceCriteria: Unit tests: drift at <= 0.001 s/s is followed; a growing backlog is dropped and never resyncs; a backward clock step after >= 1.0 s silence resyncs after 2.0 s; a stale burst never resyncs.
Category: Functional
Evidence: rover_twist_mux/src/domain/command_freshness_filter.cpp:26-28; rover_twist_mux/src/domain/command_freshness_filter.cpp:54-95; rover_twist_mux/config/rover_command_freshness.yaml:11-17
Implementation: Implemented
ParentSysSR: SYS-SR-011
Priority: Should
Status: As-Built
VerificationMethod: Test
VerifiedBy: rover_twist_mux/test/unit/test_command_freshness_filter.cpp

## 16 [SWR-MUX-016] Interface: The rover_twist_mux shall, in rover_command_freshness_node, subscribe and publish geome...
The rover_twist_mux shall, in rover_command_freshness_node, subscribe and publish geometry_msgs/TwistStamped with QoS KeepLast(10), reliable.
Rationale: Matches foxglove_bridge's reliable client publisher and twist_mux's SystemDefaults subscription; a best-effort hop would reintroduce the lost-zero risk.
AcceptanceCriteria: 'ros2 topic info -v' shows reliable, depth 10 for both endpoints of rover_command_freshness_node.
Category: Interface
Evidence: rover_twist_mux/src/infrastructure/command_freshness_node.cpp:81-90
Implementation: Implemented
ParentSysSR: SYS-SR-005
Priority: Should
Status: As-Built
VerificationMethod: Inspection
VerifiedBy: rover_twist_mux/test/integration/test_command_freshness_node.cpp

## 17 [SWR-MUX-017] Parameter: The rover_twist_mux shall, in rover_command_freshness_node, treat the nodes parameters ...
The rover_twist_mux shall, in rover_command_freshness_node, treat the node's parameters as read-only and reject max_delay outside [0.05, 5.0] s, max_clock_drift outside [0.0, 0.1], resync_time outside [0.5, 60.0] s and resync_gap outside [0.1, 60.0] s.
Rationale: Prevents runtime changes to a safety-relevant filter and nonsensical settings.
AcceptanceCriteria: Setting any parameter at runtime is refused; starting with a value outside its bound fails validation.
Category: Parameter
DerivedRationale: Parameter validation of the freshness filter (SWR-MUX-014/015).
Evidence: rover_twist_mux/src/command_freshness_params.yaml:1-43
Implementation: Implemented
Priority: Should
Status: As-Built
VerificationMethod: Inspection

## 18 [SWR-MUX-018] Diagnostics: The rover_twist_mux shall, in rover_command_freshness_node, report a Command freshness ...
The rover_twist_mux shall, in rover_command_freshness_node, report a 'Command freshness' diagnostic (hardware ID 'Command Freshness') that is WARN for 5.0 s after any dropped command and OK otherwise, with accepted/dropped/resync counts, latency baseline, last excess delay and max_delay.
Rationale: Makes a stalling Driver UI link visible on a 1 Hz dashboard, not only in the log.
AcceptanceCriteria: After a late command is injected the diagnostic is WARN, and it returns to OK once 5.0 s pass without a drop.
Category: Diagnostics
Evidence: rover_twist_mux/src/infrastructure/command_freshness_node.cpp:29-31; rover_twist_mux/src/infrastructure/command_freshness_node.cpp:124-160
Implementation: Implemented
ParentSysSR: SYS-SR-022
Priority: Could
Status: As-Built
VerificationMethod: Inspection

## 19 [SWR-MUX-019] Safety: The rover_twist_mux shall publish motion_lock immediately when a received SafetyStatus ...
The rover_twist_mux shall publish motion_lock immediately when a received SafetyStatus or SafetyCommandEcho changes the evaluated lock state, in addition to the periodic publication, so that the lock path contributes to the 100 ms software E-Stop budget.
Rationale: Today the lock is re-evaluated only in the 10 Hz timer, so a stop condition can wait up to one timer period after it arrives (on top of the 20 Hz safety_status period) before the mux is closed.
AcceptanceCriteria: Latency from publishing a SafetyCommandEcho with sw_e_stop_user_button=true to motion_lock=true is <= 100 ms in 20 of 20 trials, with the node publishing in the receiving callback rather than waiting for the timer.
Category: Safety
Comments: The primary SYS-SR-007 path is the hardware interface write() gate and the PLC latch (SAFETY_CHAIN.md:199-202), so this is defence in depth; allocate the 100 ms budget across the chain before implementing.
Evidence: rover_twist_mux/src/infrastructure/motion_lock_node.cpp:120-123; rover_twist_mux/src/infrastructure/motion_lock_node.cpp:134-145; rover_arch/SAFETY_CHAIN.md:141
Implementation: Gap
ParentSysSR: SYS-SR-007
Priority: Should
Status: Proposed
VerificationMethod: Test

## 20 [SWR-MUX-020] Interface: The rover_twist_mux shall publish which input is currently selected (or none, or locked...
The rover_twist_mux shall publish which input is currently selected (or none, or locked) on a ROS topic whenever the selection changes, for use by the platform mode manager.
Rationale: The SYS-SR-010 Teleoperation and Autonomous states can only be derived from which source currently commands the rover; no component exposes that today.
AcceptanceCriteria: Switching the active source between nav, driver_interface, joystick and cmd_elrs, and asserting motion_lock, each produces one message naming the new selection.
Category: Interface
Comments: Upstream twist_mux has no selected-input topic; this may need a small wrapper or a diagnostics-based adapter. Consumer: SWR-SAF mode manager (see rover_safety SWRS).
Evidence: rover_twist_mux/launch/rover_twist_mux.launch.py:110-119
Implementation: Gap
ParentSysSR: SYS-SR-010
Priority: Should
Status: Proposed
VerificationMethod: Test