% Requirement links of tCommandArbitration.m (R2026a)

% lines 21-22 verifies ROVER_ROS_SYS-SR.slreqx#5
% lines 21-22 verifies SWRS_MUX.slreqx#2
% lines 21-22 verifies SWRS_MUX.slreqx#3
        function testPriorityOrder(tc)
            % Verifies: SYS-SR-005, SWR-MUX-002, SWR-MUX-003

% lines 39-40 verifies ROVER_ROS_SYS-SR.slreqx#4
% lines 39-40 verifies SWRS_CTL.slreqx#8
        function testSpeedLimitAllSources(tc)
            % Verifies: SYS-SR-004, SWR-CTL-008

% lines 52-53 verifies ROVER_ROS_SYS-SR.slreqx#13
% lines 52-53 verifies SWRS_CTL.slreqx#9
        function testAccelerationLimit(tc)
            % Verifies: SYS-SR-013, SWR-CTL-009

% lines 62-63 verifies SWRS_MUX.slreqx#4
% lines 62-63 verifies SWRS_MUX.slreqx#10
% lines 62-63 verifies ROVER_ROS_SYS-SR.slreqx#6
        function testMotionLockMasksAllSources(tc)
            % Verifies: SWR-MUX-004, SWR-MUX-010, SYS-SR-006

% lines 76-77 verifies SWRS_MUX.slreqx#8
% lines 76-77 verifies ROVER_ROS_SYS-SR.slreqx#12
        function testStaleSafetyLocks(tc)
            % Verifies: SWR-MUX-008, SYS-SR-012

% lines 87-88 verifies SWRS_MUX.slreqx#7
        function testLockedAtStartup(tc)
            % Verifies: SWR-MUX-007

% lines 100-101 verifies ROVER_ROS_SYS-SR.slreqx#11
% lines 100-101 verifies SWRS_CTL.slreqx#10
% lines 100-101 verifies SWRS_MUX.slreqx#3
        function testCommandWatchdog(tc)
            % Verifies: SYS-SR-011, SWR-CTL-010, SWR-MUX-003