% Requirement links of tEStopLatch.m (R2026a)

% lines 22-23 verifies SWRS_HWI.slreqx#11
% lines 22-23 verifies ROVER_ROS_SYS-SR.slreqx#8
        function testStartupLatched(tc)
            % Verifies: SWR-HWI-011, SYS-SR-008

% lines 31-32 verifies ROVER_ROS_SYS-SR.slreqx#6
        function testHwButtonRemovesDrivePower(tc)
            % Verifies: SYS-SR-006

% lines 42-43 verifies ROVER_ROS_SYS-SR.slreqx#8
% lines 42-43 verifies SWRS_HWI.slreqx#9
        function testLatchHoldsAfterButtonRelease(tc)
            % Verifies: SYS-SR-008, SWR-HWI-009

% lines 55-56 verifies ROVER_ROS_SYS-SR.slreqx#8
        function testSetDominantLatch(tc)
            % Verifies: SYS-SR-008

% lines 64-65 verifies ROVER_ROS_SYS-SR.slreqx#8
% lines 64-65 verifies SWRS_HWI.slreqx#6
% lines 64-65 verifies SWRS_HWI.slreqx#8
        function testSwEStopNeedsLatchReset(tc)
            % Verifies: SYS-SR-008, SWR-HWI-006, SWR-HWI-008

% lines 76-77 verifies SWRS_HWI.slreqx#8
        function testSwResetRefusedWhileMoving(tc)
            % Verifies: SWR-HWI-008

% lines 86-87 verifies SWRS_HWI.slreqx#12
% lines 86-87 verifies ROVER_ROS_SYS-SR.slreqx#6
        function testCpuWatchdogLossLatches(tc)
            % Verifies: SWR-HWI-012, SYS-SR-006

% lines 95-96 verifies ROVER_ROS_SYS-SR.slreqx#7
% lines 95-96 verifies SWRS_HWI.slreqx#5
% lines 95-96 verifies SWRS_HWI.slreqx#7
        function testSwEStopZeroCommandIdealLink(tc)
            % Verifies: SYS-SR-007, SWR-HWI-005, SWR-HWI-007

% lines 105-106 verifies ROVER_ROS_SYS-SR.slreqx#7
% lines 105-106 verifies SWRS_HWI.slreqx#7
        function testSwEStopZeroCommandWorstCaseLink(tc)
            % Verifies: SYS-SR-007, SWR-HWI-007

% lines 114-115 verifies ROVER_ROS_SYS-SR.slreqx#23
% lines 114-115 verifies SWRS_HWI.slreqx#16
        function testEStopStatePublishLatency(tc)
            % Verifies: SYS-SR-023, SWR-HWI-016

% lines 134-135 verifies SWRS_HWI.slreqx#10
        function testLatchResetRefusedWhileMoving(tc)
            % Verifies: SWR-HWI-010