% Requirement links of tPlatformModeManager.m (R2026a)

% lines 24-25 verifies ROVER_ROS_SYS-SR.slreqx#10
% lines 24-25 verifies SWRS_SAF.slreqx#18
% lines 24-25 verifies SWRS_SAF.slreqx#19
        function testEveryStateReachable(tc)
            % Verifies: SYS-SR-010, SWR-SAF-018, SWR-SAF-019

% lines 31-32 verifies ROVER_ROS_SYS-SR.slreqx#9
% lines 31-32 verifies SWRS_SAF.slreqx#22
% lines 31-32 verifies SWRS_LED.slreqx#10
        function testLedMapping(tc)
            % Verifies: SYS-SR-009, SWR-SAF-022, SWR-LED-010

% lines 42-43 verifies ROVER_ROS_SYS-SR.slreqx#10
% lines 42-43 verifies SWRS_SAF.slreqx#19
% lines 42-43 verifies SWRS_MUX.slreqx#20
        function testTeleopAutonomousFollowActiveSource(tc)
            % Verifies: SYS-SR-010, SWR-SAF-019, SWR-MUX-020

% lines 54-55 verifies ROVER_ROS_SYS-SR.slreqx#8
% lines 54-55 verifies ROVER_ROS_SYS-SR.slreqx#10
% lines 54-55 verifies SWRS_SAF.slreqx#19
        function testEStopHasPriorityAndNeedsClear(tc)
            % Verifies: SYS-SR-008, SYS-SR-010, SWR-SAF-019

% lines 68-69 verifies SWRS_SAF.slreqx#21
% lines 68-69 verifies ROVER_ROS_SYS-SR.slreqx#10
        function testFaultNeedsReset(tc)
            % Verifies: SWR-SAF-021, SYS-SR-010

% lines 79-80 verifies ROVER_ROS_SYS-SR.slreqx#17
% lines 79-80 verifies SWRS_SAF.slreqx#20
        function testLowBatteryWarningAndSafeStop(tc)
            % Verifies: SYS-SR-017, SWR-SAF-020

% lines 95-96 verifies ROVER_ROS_SYS-SR.slreqx#10
% lines 95-96 verifies SWRS_SAF.slreqx#18
        function testNoMotionOutsideOperationalStates(tc)
            % Verifies: SYS-SR-010, SWR-SAF-018

% lines 105-106 verifies ROVER_ROS_SYS-SR.slreqx#9
% lines 105-106 verifies SWRS_LED.slreqx#20
% lines 105-106 verifies SWRS_MSG.slreqx#10
        function testLedDefinedForEveryState(tc)
            % Verifies: SYS-SR-009, SWR-LED-020, SWR-MSG-010