% Requirement links of tSkidSteerKinematics.m (R2026a)

% lines 20-21 verifies ROVER_ROS_SYS-SR.slreqx#3
% lines 20-21 verifies SWRS_CTL.slreqx#5
% lines 20-21 verifies SWRS_CTL.slreqx#6
        function testStraightOdometryError(tc)
            % Verifies: SYS-SR-003, SWR-CTL-005, SWR-CTL-006

% lines 31-32 verifies ROVER_ROS_SYS-SR.slreqx#3
% lines 31-32 verifies SWRS_CTL.slreqx#5
        function testRotationRoundTrip(tc)
            % Verifies: SYS-SR-003, SWR-CTL-005

% lines 39-40 verifies ROVER_ROS_SYS-SR.slreqx#4
% lines 39-40 verifies SWRS_CTL.slreqx#11
        function testRimSpeedWithinJointLimit(tc)
            % Verifies: SYS-SR-004, SWR-CTL-011

% lines 51-52 verifies ROVER_ROS_SYS-SR.slreqx#2
% lines 51-52 verifies SWRS_CTL.slreqx#1
% lines 51-52 verifies SWRS_CTL.slreqx#16
        function testControlRates(tc)
            % Verifies: SYS-SR-002, SWR-CTL-001, SWR-CTL-016

% lines 62-63 verifies ROVER_ROS_SYS-SR.slreqx#2
        function testEncoderFeedbackRate(tc)
            % Verifies: SYS-SR-002

% lines 69-70 verifies ROVER_ROS_SYS-SR.slreqx#19
% lines 69-70 verifies SWRS_CTL.slreqx#15
        function testImuPublishRate(tc)
            % Verifies: SYS-SR-019, SWR-CTL-015